# Dynamo graph ColorDirectly_Final_20230323_CORR_E2E_2_script_with_export_switch_ADVANCED.dyn (Dynamo 2.10.1.3976)

# group: Input parameters
SITE_X = DoubleSlider(25, range=20..60 step 5)  # graph input
SITE_Y = DoubleSlider(20, range=10..40 step 5)  # graph input
corridor_width = DoubleSlider(2, range=2..4 step 1)  # graph input
NUM_ROOMS_SHORT_SIDE = DoubleSlider(3, range=2..15 step 1)  # graph input
NUM_ROOMS_LONG_SIDE = DoubleSlider(3, range=2..15 step 1)  # graph input
INCLUDE_BOTTLENECK = BoolSelector(false)  # graph input

parameter_processing_py = Python(IN[0]=SITE_X, IN[1]=SITE_Y, IN[2]=corridor_width, IN[3]=NUM_ROOMS_SHORT_SIDE, IN[4]=NUM_ROOMS_LONG_SIDE, IN[5]=INCLUDE_BOTTLENECK)  # CPython3
# ---------- parameter_processing_py.python (25 lines) ----------
# Phython-Standard- und DesignScript-Bibliotheken laden
import sys
import os
import clr
clr.AddReference('ProtoGeometry')
from Autodesk.DesignScript.Geometry import *

# Die Eingaben für diesen Block werden in Form einer Liste in den IN-Variablen gespeichert.
dataEnteringNode = IN

# Code unterhalb dieser Linie platzieren
site_x = int(IN[0])                                # the overall length of the site
site_y = int(IN[1])                                # the overall widthness of the site
CORR_WIDTH = int(IN[2]) # convert_meter_to_unit(3)
NUM_ROOMS_SHORT_SIDE = int(IN[3])
NUM_ROOMS_LONG_SIDE = int(IN[4])
INCLUDE_BOTTLENECK = bool(IN[5])
#store_dir = IN[6]
#layout_name = IN[7]


txt_filename = \
    'floorplan_siteX_'+str(int(site_x))+'_siteY_'+str(int(site_y))+'_CORRWIDTH_'+str(CORR_WIDTH)+ '_NUMROOMS_'+str(NUM_ROOMS_SHORT_SIDE)+'_'+str(NUM_ROOMS_LONG_SIDE)+'_INCBNECK_'+str(INCLUDE_BOTTLENECK)+'.txt'
# Weisen Sie Ihre Ausgabe der OUT-Variablen zu.
OUT = txt_filename, [site_x, site_y, CORR_WIDTH, NUM_ROOMS_SHORT_SIDE, NUM_ROOMS_LONG_SIDE, INCLUDE_BOTTLENECK]
# ----------------------------------------

# group: Settings
true_create_building_false = BoolSelector(true)  # "True== Create Building // False==Export Floorplan"; graph input
directory_path = Directory("C:\Users\ga78jem\Documents\Revit\Exports_EGICE")
create_folder_structure = BoolSelector(false)  # graph input

string = StringInput("corr_e2e")
create_folder_py = Python(IN[0]=parameter_processing_py, IN[1]=true_create_building_false, IN[2]=directory_path, IN[3]=string, IN[4]=create_folder_structure)  # IronPython2; graph output
# ---------- create_folder_py.python (59 lines) ----------
# Phython-Standard- und DesignScript-Bibliotheken laden
import sys
import clr
clr.AddReference('ProtoGeometry')
from Autodesk.DesignScript.Geometry import *
import os
import shutil

clr.AddReference("RevitServices")
import RevitServices
from RevitServices.Persistence import DocumentManager 
doc = DocumentManager.Instance.CurrentDBDocument

# Die Eingaben für diesen Block werden in Form einer Liste in den IN-Variablen gespeichert.
dataEnteringNode = IN

# Code unterhalb dieser Linie platzieren

txt_filename = IN[0][0]
do_create = IN[1]
store_dir = IN[2]
layout_name = str(IN[3])
create_folder_structure = IN[4]

new_folder_name = None
txt_filepath = None

if create_folder_structure:

	dataset_folder_name = os.path.join(store_dir, layout_name)
	if not os.path.isdir(dataset_folder_name): os.mkdir(dataset_folder_name)
	
	new_folder_name = txt_filename.replace('.txt', '')
	# only check for duplicate settings when creating a new subfolder corresponding to the settings
	prefix = None
	if do_create:
		if len(os.listdir(dataset_folder_name)) > 0:
			for dirname in os.listdir(dataset_folder_name):
				assert new_folder_name != dirname.split('__')[-1], 'Duplicate settings!'
		prefix = str(len(os.listdir(dataset_folder_name)))+'__'
	
	elif not do_create:
		for dirname in os.listdir(dataset_folder_name):
			if new_folder_name == dirname.split('__')[-1]:
				prefix = dirname.split('__')[0] + '__'
	
	assert prefix, 'folder prefix is empty or doesnt exist, probably because a folder does not exist'
	new_folder_name = prefix+new_folder_name
	new_folder_name = os.path.join(dataset_folder_name, new_folder_name)
	
	# dont create the folder when exporting (it should already be there from the previous step...
	if do_create:
		os.mkdir(new_folder_name)
	#shutil.move(txt_filename, new_folder_name)
	txt_filepath = os.path.join(new_folder_name, txt_filename)

#doc.Regenerate()
# Weisen Sie Ihre Ausgabe der OUT-Variablen zu.
OUT = txt_filepath, do_create
# ----------------------------------------

# group: Floorplan View
element_types = ElementTypes("ViewPlan")
all_elements_of_type = ElementsOfType(element_type=element_types)
watch = Watch(all_elements_of_type)
viewplan_selector = CodeBlock(IN=watch) { OUT=IN[0]; }
id = Element.Id(element=viewplan_selector)

# group: Wall & Floor Types
default_exterior_wall_types = WallTypes("Wall-Ret_300Con")
default_floor_types = FloorTypes("Generic 150mm - Filled")
default_interior_wall_types = WallTypes("Wall-Ret_300Con")

door_width = DoubleInput(0.915)
obstacle_width = DoubleInput(0.8)
create_corridor_end2end_py = Python(IN[0]=default_exterior_wall_types, IN[1]=default_floor_types, IN[2]=default_interior_wall_types, IN[3]=parameter_processing_py, IN[4]=true_create_building_false, IN[5]=door_width, IN[6]=obstacle_width)  # CPython3
# ---------- create_corridor_end2end_py.python (551 lines) ----------
###############################################################
# Load the Libraries
###############################################################
import os
import clr
import sys
import math
import System

from System import Array
from System.Collections.Generic import *

clr.AddReference("RevitNodes")
import Revit

clr.ImportExtensions(Revit.Elements)
clr.ImportExtensions(Revit.GeometryConversion)

clr.AddReference("RevitServices")
import RevitServices
from RevitServices.Persistence import DocumentManager 
from RevitServices.Transactions import TransactionManager 

clr.AddReference("RevitAPI")
clr.AddReference("RevitAPIUI")

clr.AddReference('ProtoGeometry')
import Autodesk 
from Autodesk.DesignScript.Geometry import *
from Autodesk.Revit.DB import *
#from Autodesk.Revit.UI import *
from Autodesk.Revit.DB import StairsEditScope
from Autodesk.Revit.DB import Parameter
from Autodesk.Revit.DB.Architecture import StairsRun
from Autodesk.Revit.DB.Architecture import *
from Autodesk.Revit.DB import IFailuresPreprocessor

###############################################################
# Customize functions 
###############################################################
"""
Converts default unit in Dynamo into meter...
"""
def convert_meter_to_unit(pre_value):
    tempo_list = []
    tempo_value = 0
    if isinstance(pre_value, list):
        len_list = len(pre_value)
        for ii in range(len_list):
            tempo_list.append (float(UnitUtils.ConvertToInternalUnits(pre_value[ii], UnitTypeId.Meters)))
        pre_value = tempo_list
    else:
        tempo_value = float(UnitUtils.ConvertToInternalUnits(pre_value, UnitTypeId.Meters))
        pre_value = tempo_value
    return pre_value


def convert_to_meter(internal_value):
	if isinstance(internal_value, list):
		return [UnitUtils.ConvertFromInternalUnits(value, UnitTypeId.Meters) for value in internal_value]
	return float(UnitUtils.ConvertFromInternalUnits(internal_value, UnitTypeId.Meters))

"""
Provide perimeter lines from three dimensions...
"""
def find_perimeter_lines(x,y,z):
    line_list = []
    xx = x
    yy = y
    zz = z 
    # print "find_perimeter_lines x: " + str(x)
    # print "find_perimeter_lines y: " + str(y)
    # print "find_perimeter_lines z: " + str(z)
	
    line_1 = Autodesk.Revit.DB.Line.CreateBound(XYZ(0,0,zz),    XYZ(xx,0,zz))
    line_2 = Autodesk.Revit.DB.Line.CreateBound(XYZ(xx,0,zz),   XYZ(xx,yy,zz))
    line_3 = Autodesk.Revit.DB.Line.CreateBound(XYZ(xx,yy,zz),  XYZ(0,yy,zz))
    line_4 = Autodesk.Revit.DB.Line.CreateBound(XYZ(0,yy,zz),   XYZ(0,0,zz))

    line_list.append(line_1)
    line_list.append(line_2)
    line_list.append(line_3)
    line_list.append(line_4)
    
    return line_list

"""
Provide the geometry of slab by level...
"""
def slab_geometry_by_level(x,y,level,delta_z):
    zz = level.Elevation + delta_z
    xx = x
    yy = y 
    line_1 = Autodesk.Revit.DB.Line.CreateBound(XYZ(0,0,zz),    XYZ(xx,0,zz))
    line_2 = Autodesk.Revit.DB.Line.CreateBound(XYZ(xx,0,zz),   XYZ(xx,yy,zz))
    line_3 = Autodesk.Revit.DB.Line.CreateBound(XYZ(xx,yy,zz),  XYZ(0,yy,zz))
    line_4 = Autodesk.Revit.DB.Line.CreateBound(XYZ(0,yy,zz),   XYZ(0,0,zz))
    
    slab_geometry = CurveArray()
    slab_geometry.Append(line_1)
    slab_geometry.Append(line_2)
    slab_geometry.Append(line_3)
    slab_geometry.Append(line_4)
    return slab_geometry

###############################################################
# Current doc/app/ui
###############################################################
doc = DocumentManager.Instance.CurrentDBDocument
# uiapp = DocumentManager.Instance.CurrentUIApplication 
# app = uiapp.Application
# uidoc = uiapp.ActiveUIDocument

###############################################################
# Prepare the input
###############################################################
default_exterior_wall_type = UnwrapElement(IN[0])                   # Default exterior wall type
default_floor_type = UnwrapElement(IN[1])                           # Default Floor type
default_interior_wall_type = UnwrapElement(IN[2])				# Default interior wall type
### INPUT PARAMETERS ###
parameter_list = IN[3][1]
site_x = parameter_list[0]                                # the overall length of the site
site_y = parameter_list[1]                                # the overall widthness of the site
CORR_WIDTH = parameter_list[2] # convert_meter_to_unit(3)
NUM_ROOMS_SHORT_SIDE = parameter_list[3]
NUM_ROOMS_LONG_SIDE = parameter_list[4]
USE_BOTTLENECKS = parameter_list[5]

create_mode = IN[4]
DOOR_WIDTH_H = convert_meter_to_unit(float(IN[5])/2.)
OBSTACLE_WIDTH = float(IN[6])

number_story = 1                                          # the total amount of the stories;
story_z = [0]
site_z = 4                                              # the overall height of the site
ref_level_z = 0                                         # the z-position of the reference level (default level = level 0, created in the prepared .rvt)
###############################################################
# Transaction in Revit
###############################################################
TransactionManager.Instance.EnsureInTransaction(doc)
###############################################################
# Define the output
###############################################################

# Create room dict
room_dict = {}

if create_mode:
    geo_site = []                                                       # archive all the input data
    ref_level = []                                                      # the reference level
    bbox_site = []                                                      # bounding box of the site

    # sys.path.append('C:\Users\ga78jem\Miniconda3\envs\trajectron++\Lib\site-packages')

    ###############################################################
    # Convert the Units | b = UnitUtils.ConvertToInternalUnits(a, UnitTypeId.Meters)  b = a*3 | c = UnitUtils.ConvertFromInternalUnits(a, UnitTypeId.Meters)  c = a*3
    ###############################################################

    # print "site x before conversion:" + str(site_x)
    # adjust the sizes to account for wall thickness
    site_x -= 0.3
    site_y -= 0.3
    site_x = convert_meter_to_unit(site_x)
    site_y = convert_meter_to_unit(site_y)
    site_z = convert_meter_to_unit(site_z)
    ref_level_z = convert_meter_to_unit(ref_level_z)
    CORR_WIDTH = convert_meter_to_unit(CORR_WIDTH)
    # print "site x after conversion:" + str(site_x)

    ###############################################################
    # Delete all levels apart from the reference level (when there are multiple levels)
    ###############################################################
    # Collect all levels
    levelArray = (FilteredElementCollector(doc)
        .OfCategory(BuiltInCategory.OST_Levels)
        .WhereElementIsNotElementType()
        .ToElements())

    def clear_model(bool_value):
        if bool_value:
            del_grid = FilteredElementCollector(doc).OfCategory(BuiltInCategory.OST_Grids).WhereElementIsNotElementType().ToElements()
            del_door = FilteredElementCollector(doc).OfCategory(BuiltInCategory.OST_Doors).WhereElementIsNotElementType().ToElements()
            del_floor = FilteredElementCollector(doc).OfCategory(BuiltInCategory.OST_Floors).WhereElementIsNotElementType().ToElements()
            del_wall = FilteredElementCollector(doc).OfCategory(BuiltInCategory.OST_Walls).WhereElementIsNotElementType().ToElements()
            del_roof = FilteredElementCollector(doc).OfCategory(BuiltInCategory.OST_Roofs).WhereElementIsNotElementType().ToElements()
            del_all = [del_grid, del_door, del_floor, del_wall, del_roof]
            for element_type in del_all:
                for element in element_type:
                    doc.Delete(element.Id)

    clear_model(True)

    # Check the number of the existing levels, if multiple, delete and save only one
    if len(levelArray) > 1:
        #print "levelArray.Count > 1, from 01_Site"
        for levelElement in levelArray:
            if levelElement.Elevation != ref_level_z:
                doc.Delete(levelElement.Id)
    ref_level = levelArray[0]
    ref_level.Name = "Story Level 0"

    # Check the if the saved one is the reference level, correct it if not
    if ref_level.Elevation != ref_level_z:
        ref_level_new = Autodesk.Revit.DB.Level.Create(doc, ref_level_z)
        doc.Delete(ref_level.Id)
        ref_level = ref_level_new
        ref_level.Name = "Story Level 0"

    #--------------------------------------------------------------
    #------------------ OK NOW YOU CAN CODE -----------------------
    #--------------------------------------------------------------

    # Create Bounding Box
    bb = BoundingBoxXYZ()
    bb.Min = XYZ(0, 0, 0)
    bb.Max = XYZ(0, 0, site_z)
    bbox_site.append(bb.ToProtoType())                  # the bounding box of the entire site
    # Close and save the recording file
    # geo_site.append(site_x)
    # geo_site.append(site_y)
    # geo_site.append(site_z)

    ###############################################################
    # END OF SCRIPT 1
    # START OF SCRIPT 2
    ###############################################################

    archive_data = []                                                   # archive all the input data
    bbox_story = []
    exterior_wall_list = []
    floor_list = []
    roof_list = []
    entrance_door_list = []

    ###############################################################
    # Convert the Units | b = UnitUtils.ConvertToInternalUnits(a, UnitTypeId.Meters)  b = a*3 | c = UnitUtils.ConvertFromInternalUnits(a, UnitTypeId.Meters)  c = a*3
    ###############################################################
    story_z = convert_meter_to_unit(story_z)

    # Collect all levels
    levelArray = (FilteredElementCollector(doc)
        .OfCategory(BuiltInCategory.OST_Levels)
        .WhereElementIsNotElementType()
        .ToElements())

    # Check the number of the existing levels, if multiple, delete and save only one
    if len(levelArray) > 1:
        #print "levelArray.Count > 1, from 02_Story"
        for levelElement in levelArray:
            if levelElement.Elevation != ref_level.Elevation:
                doc.Delete(levelElement.Id)
    ref_level = levelArray[0]
    ref_level.Name = "Story Level 0"

    # Check the if the saved one is the reference level, correct it if not
    if ref_level.Elevation != 0:
        ref_level_new = Autodesk.Revit.DB.Level.Create(doc, 0)
        doc.Delete(ref_level.Id)
        ref_level = ref_level_new
        ref_level.Name = "Story Level 0"

    ###############################################################
    # Check the consistence with the bouning box of the side 
    ###############################################################
    # Check the z-position of the highest story against the site box

    check_site_story = True if max(story_z) < site_z else False
    #print "The stories are consistent with the overal site:" + str(check_site_story)

    # Create new story levels
    for ii in range(number_story):
        if ref_level.Elevation == story_z[ii]:
            continue
        new_level = Autodesk.Revit.DB.Level.Create(doc, story_z[ii])
        new_level.Name = "Story Level " + str(ii)

    # Create the roof level
    roof_level = Autodesk.Revit.DB.Level.Create(doc, site_z)
    roof_level.Name = "Roof Level"

    # all levels
    allLevels = FilteredElementCollector(doc).OfClass(Level).ToElements()

    # Create Bounding Box for each story level
    for ii in range(number_story):
        level_bbox_end_z = story_z[ii+1] if ii < (number_story-1) else site_z
        #print "Story"+str(ii)
        #print str(level_bbox_end_z)
        bb = BoundingBoxXYZ()
        bb.Min = XYZ(0, 0, story_z[ii])
        bb.Max = XYZ(site_x, site_y, level_bbox_end_z)
        bbox_story.append(bb.ToProtoType())

    ##############################################################################################################################
    ##############################################################################################################################
    # Create floorplan complexity
    ##############################################################################################################################
    ##############################################################################################################################

    WIDTH = site_y
    LENGTH = site_x
    print('x_length: ' + str(convert_to_meter(LENGTH)))
    print('y_width: ' + str(convert_to_meter(WIDTH)))
    print("")
    z_level = ref_level.Elevation
    ceiling = allLevels[0].Elevation

    obstacle_counter = 0

    # Create the exterior walls
    perimeter_lines = find_perimeter_lines(LENGTH, WIDTH, z_level)
    for ww in range(4):
        wall = Wall.Create(doc, perimeter_lines[ww], default_exterior_wall_type.Id, ref_level.Id, site_z, 0, False, True)
        exterior_wall_list.append(wall)

    # Create floor for each story level
    for ii in range(number_story):
        ll = allLevels[ii]
        floor_geometry = slab_geometry_by_level(LENGTH, WIDTH, ll, 0.0)
        floor = doc.Create.NewFloor(floor_geometry, default_floor_type, ll, True)
        floor_list.append(floor)

    # Create corridor lines
    y_main_corridor = 0.5*WIDTH
    x_main_corridor_start = 1.5*CORR_WIDTH
    x_main_corridor_end = LENGTH-1.5*CORR_WIDTH
        
    bottlneck_ys = [CORR_WIDTH, WIDTH-CORR_WIDTH]

    P0_long = XYZ(x_main_corridor_start, 0, ceiling)
    P1_long = XYZ(x_main_corridor_start, y_main_corridor - CORR_WIDTH/2., ceiling)
    P2_long = XYZ(LENGTH, y_main_corridor - CORR_WIDTH/2., ceiling)

    line_corr_0_long = Autodesk.Revit.DB.Line.CreateBound(P0_long, P1_long)
    line_corr_1_long = Autodesk.Revit.DB.Line.CreateBound(P1_long, P2_long)

    P1_short = XYZ(0, y_main_corridor + CORR_WIDTH/2., ceiling)
    P2_short = XYZ(x_main_corridor_end, y_main_corridor + CORR_WIDTH/2., ceiling)
    P3_short = XYZ(x_main_corridor_end, WIDTH, ceiling)
    
    line_corr_1_short = Autodesk.Revit.DB.Line.CreateBound(P1_short, P2_short)
    line_corr_2_short = Autodesk.Revit.DB.Line.CreateBound(P2_short, P3_short)

    corr_room_lines = [line_corr_1_short, line_corr_2_short, line_corr_0_long, line_corr_1_long] # , line_corr_2_long, line_corr_3_long]
    # Create corridor-room walls
    corr_walls = [Wall.Create(doc, wall_line, default_interior_wall_type.Id, allLevels[0].Id, allLevels[1].Elevation - allLevels[0].Elevation, 0, False, True) \
        for wall_line in corr_room_lines]

    # obstacles
    obstacle_length = 1.

    x_obst_min, x_obst_max = convert_to_meter(x_main_corridor_end)+0.1, convert_to_meter(x_main_corridor_end)+0.1+obstacle_length
    y_obst_min, y_obst_max = convert_to_meter(y_main_corridor + CORR_WIDTH/2.)+0.5, convert_to_meter(y_main_corridor + CORR_WIDTH/2.)+0.5+OBSTACLE_WIDTH
    room_dict.update({
        'CROWDIT_OBSTACLE_'+str(obstacle_counter)+'_1_1_': [
                (x_obst_min, y_obst_min),
                (x_obst_max, y_obst_max)
            ]
        }
    )
    obstacle_counter += 1

    x_obst_min, x_obst_max = convert_to_meter(x_main_corridor_start)-0.1-obstacle_length, convert_to_meter(x_main_corridor_start)-0.1
    y_obst_min, y_obst_max = convert_to_meter(y_main_corridor - CORR_WIDTH/2.)-0.5-OBSTACLE_WIDTH, convert_to_meter(y_main_corridor - CORR_WIDTH/2.)-0.5
    room_dict.update({
        'CROWDIT_OBSTACLE_'+str(obstacle_counter)+'_1_1_': [
                (x_obst_min, y_obst_min),
                (x_obst_max, y_obst_max)
            ]
        }
    )
    obstacle_counter += 1
    

    # destination areas
    bottlneck_ys_room_dict = [0, WIDTH]
    origin_opening_list = []
    
    x_min_fixed_1, x_max_fixed_1 = min(0, x_main_corridor_start), max(0, x_main_corridor_start)
    y_min_fixed_1, y_max_fixed_1 = min(bottlneck_ys[0], bottlneck_ys_room_dict[0]), max(bottlneck_ys[0], bottlneck_ys_room_dict[0])

    room_dict.update({
        'CROWDIT_DESTINATION_0': [
                (convert_to_meter(x_min_fixed_1)+0.5, convert_to_meter(y_min_fixed_1)+0.5),
                (convert_to_meter(x_max_fixed_1)-0.5, convert_to_meter(y_max_fixed_1)-0.5)
            ]
        }
    )

    x_min_fixed_2, x_max_fixed_2 = min(x_main_corridor_end, LENGTH), max(x_main_corridor_end, LENGTH)
    y_min_fixed_2, y_max_fixed_2 = min(bottlneck_ys[1], bottlneck_ys_room_dict[1]), max(bottlneck_ys[1], bottlneck_ys_room_dict[1])

    room_dict.update({
        'CROWDIT_DESTINATION_1': [
                (convert_to_meter(x_min_fixed_2)+0.5, convert_to_meter(y_min_fixed_2)+0.5),
                (convert_to_meter(x_max_fixed_2)-0.5, convert_to_meter(y_max_fixed_2)-0.5)
            ]
        }
    )

    ###############
    # Office rooms
    ###############
    # DOOR_WIDTH_H = convert_meter_to_unit(0.5)
    DOOR_HEIGHT = convert_meter_to_unit(2.2)
    DOOR_THICKNESS_H = convert_meter_to_unit(0.25)

    # short side
    fractions = [1./(NUM_ROOMS_SHORT_SIDE)*i for i in range(NUM_ROOMS_SHORT_SIDE+1)]
    short_x_coord_list = [P1_short[0] + fr * (P2_short[0] - P1_short[0]) for fr in fractions]
    
    for x_coord in short_x_coord_list[1:-1]:
        office_office_line = Autodesk.Revit.DB.Line.CreateBound(
                XYZ(x_coord, P2_short[1], ceiling),
                XYZ(x_coord, P3_short[1], ceiling))
        Wall.Create(doc, office_office_line, default_interior_wall_type.Id, allLevels[0].Id, allLevels[1].Elevation - allLevels[0].Elevation, 0, False, True)
    
    # create openings short offices
    for id in range(len(short_x_coord_list)-1):
        x_opening = (short_x_coord_list[id+1] + short_x_coord_list[id])/2.
        y_opening = P1_short[1]
        z_opening = z_level

        start_point = XYZ(x_opening-DOOR_WIDTH_H, y_opening-DOOR_THICKNESS_H, z_opening)
        end_point = XYZ(x_opening+DOOR_WIDTH_H, y_opening+DOOR_THICKNESS_H, z_opening+DOOR_HEIGHT)
        origin_opening_list.append(doc.Create.NewOpening(corr_walls[0], start_point, end_point))

        y_min_var_short, y_max_var_short = min(P1_short[1], P3_short[1]), max(P1_short[1], P3_short[1])

        room_dict.update({
            'CROWDIT_ORIGIN_'+str(id): [
                    (convert_to_meter(short_x_coord_list[id])+0.5, convert_to_meter(y_min_var_short)+0.5),
                    (convert_to_meter(short_x_coord_list[id+1])-0.5, convert_to_meter(y_max_var_short)-0.5)
                ]
            }
        )

        if id > 0:
            # obstacle: rectangle (e.g. table: 2x1 m rectangle)
            obstacle_length = 2.
            if y_opening < y_main_corridor:
                y_obst_min = convert_to_meter(y_opening)+0.1
                y_obst_max = convert_to_meter(y_opening)+0.1+OBSTACLE_WIDTH
            else:
                y_obst_min = convert_to_meter(y_opening)-0.1-OBSTACLE_WIDTH
                y_obst_max = convert_to_meter(y_opening)-0.1

            room_dict.update({
                'CROWDIT_OBSTACLE_'+str(obstacle_counter)+'_2_1_': [
                        (convert_to_meter(short_x_coord_list[id])-obstacle_length/2., y_obst_min),
                        (convert_to_meter(short_x_coord_list[id])+obstacle_length/2., y_obst_max)
                    ]
                }
            )
            obstacle_counter += 1


    # long side
    # create openings long offices
    fractions = [1./(NUM_ROOMS_LONG_SIDE)*i for i in range(NUM_ROOMS_LONG_SIDE+1)]
    long_x_coord_list = [P1_long[0] + fr * (P2_long[0] - P1_long[0]) for fr in fractions]

    for x_coord in long_x_coord_list[1:-1]:
        office_office_line = Autodesk.Revit.DB.Line.CreateBound(
                XYZ(x_coord, P2_long[1], ceiling),
                XYZ(x_coord, P0_long[1], ceiling))
        Wall.Create(doc, office_office_line, default_interior_wall_type.Id, allLevels[0].Id, allLevels[1].Elevation - allLevels[0].Elevation, 0, False, True)

    
    # create openings long offices
    for id in range(len(long_x_coord_list[:-1])):
        x_opening = (long_x_coord_list[id+1] + long_x_coord_list[id])/2.
        y_opening = P1_long[1]
        z_opening = z_level

        start_point = XYZ(x_opening-DOOR_WIDTH_H, y_opening-DOOR_THICKNESS_H, z_opening)
        end_point = XYZ(x_opening+DOOR_WIDTH_H, y_opening+DOOR_THICKNESS_H, z_opening+DOOR_HEIGHT)
        origin_opening_list.append(doc.Create.NewOpening(corr_walls[3], start_point, end_point))

        y_min_var_long, y_max_var_long = min(P0_long[1], P1_long[1]), max(P0_long[1], P1_long[1])
        room_dict.update({
            'CROWDIT_ORIGIN_'+str(id+len(short_x_coord_list)-1): [
                    (convert_to_meter(long_x_coord_list[id])+0.5, convert_to_meter(y_min_var_long)+0.5),
                    (convert_to_meter(long_x_coord_list[id+1])-0.5, convert_to_meter(y_max_var_long)-0.5)
                ]
            }
        )

        if id > 0:
            # obstacle: rectangle (e.g. table: 2x1 m rectangle)
            obstacle_length = 2.
            if y_opening < y_main_corridor:
                y_obst_min = convert_to_meter(y_opening)+0.1
                y_obst_max = convert_to_meter(y_opening)+0.1+OBSTACLE_WIDTH
            else:
                y_obst_min = convert_to_meter(y_opening)-0.1-OBSTACLE_WIDTH
                y_obst_max = convert_to_meter(y_opening)-0.1

            room_dict.update({
                'CROWDIT_OBSTACLE_'+str(obstacle_counter)+'_2_1_': [
                        (convert_to_meter(long_x_coord_list[id])-obstacle_length/2., y_obst_min),
                        (convert_to_meter(long_x_coord_list[id])+obstacle_length/2., y_obst_max)
                    ]
                }
            )
            obstacle_counter += 1


    if USE_BOTTLENECKS:
        bottleneck_lines = [
            Autodesk.Revit.DB.Line.CreateBound(
                XYZ(0, bottlneck_ys[0], ceiling),
                XYZ(x_main_corridor_start, bottlneck_ys[0], ceiling)),
            
            Autodesk.Revit.DB.Line.CreateBound(
                XYZ(x_main_corridor_end, bottlneck_ys[1], ceiling),
                XYZ(LENGTH, bottlneck_ys[1], ceiling))
        ]
        
        bottleneck_walls = [Wall.Create(doc, line, default_interior_wall_type.Id, allLevels[0].Id, allLevels[1].Elevation - allLevels[0].Elevation, 0, False, True)
            for line in bottleneck_lines]

        # some doors
        x_opening_1 = x_main_corridor_start/2.
        y_opening_1 = bottlneck_ys[0]
        z_opening_1 = z_level

        start_point_1 = XYZ(x_opening_1-DOOR_WIDTH_H, y_opening_1-DOOR_THICKNESS_H, z_opening_1)
        end_point_1 = XYZ(x_opening_1+DOOR_WIDTH_H, y_opening_1+DOOR_THICKNESS_H, z_opening+DOOR_HEIGHT)
        opening_1 = doc.Create.NewOpening(bottleneck_walls[0], start_point_1, end_point_1)

        x_opening_2 = x_main_corridor_end + (LENGTH-x_main_corridor_end)/2.
        y_opening_2 = bottlneck_ys[1]
        z_opening_2 = z_level

        start_point_2 = XYZ(x_opening_2-DOOR_WIDTH_H, y_opening_2-DOOR_THICKNESS_H, z_opening_2)
        end_point_2 = XYZ(x_opening_2+DOOR_WIDTH_H, y_opening_2+DOOR_THICKNESS_H, z_opening_2+DOOR_HEIGHT)
        opening_2 = doc.Create.NewOpening(bottleneck_walls[1], start_point_2, end_point_2)

    assert len(origin_opening_list) == len([key for key in room_dict if key.startswith('CROWDIT_ORIGIN_')])
    
#--------------------------------------------------------------
#------------------ OK NOW END THE CODE -----------------------
#--------------------------------------------------------------

TransactionManager.Instance.TransactionTaskDone()

###############################################################
# Prepare the output 
###############################################################
OUT = room_dict # , len([key for key in room_dict if key.startswith('CROWDIT_OBSTACLE_')])
# ----------------------------------------

# group: Export
export2dxf_py = Python(IN[0]=create_folder_py, IN[1]=id)  # IronPython2
# ---------- export2dxf_py.python (59 lines) ----------
# Phython-Standard- und DesignScript-Bibliotheken laden
import sys
import os
import clr
clr.AddReference('ProtoGeometry')
from Autodesk.DesignScript.Geometry import *

clr.AddReference("RevitNodes")
import Revit

clr.ImportExtensions(Revit.Elements)
clr.ImportExtensions(Revit.GeometryConversion)

clr.AddReference("RevitServices")
import RevitServices
from RevitServices.Persistence import DocumentManager 
from RevitServices.Transactions import TransactionManager 

# Import RevitAPI
clr.AddReference("RevitAPI")
import Autodesk
from Autodesk.Revit.DB import *

clr.AddReference('System')
#from System.Collections.Generic import *
from System.Collections.Generic import List

# Die Eingaben für diesen Block werden in Form einer Liste in den IN-Variablen gespeichert.
dataEnteringNode = IN

# Code unterhalb dieser Linie platzieren
###############################################################
# Current doc/app/ui
###############################################################
doc = DocumentManager.Instance.CurrentDBDocument

txt_filepath = IN[0][0]
do_create = IN[0][1]
viewId = IN[1]

def ExportDxf(name, id, folder, filename):
	options = DXFExportOptions()
	options.TargetUnit = ExportUnit.Meter
	views = List[ElementId]()
	views.Add(ElementId(id))
	result = doc.Export(folder, name, views, options)
	return result

fullpath = None
if not do_create and txt_filepath: 
	folderPath = '\\'.join(txt_filepath.split('\\')[:-1])
	filename = txt_filepath.split('\\')[-1].replace('.txt', '.dxf')
	
	assert not os.path.isfile(os.path.join(folderPath, filename)), '.dxf already exists!'
	ExportDxf(filename, viewId, folderPath, filename)
	fullpath = txt_filepath.replace('.txt', '.dxf')

#Assign your output to the OUT variable
OUT = fullpath
# ----------------------------------------
export2pdf_py = Python(IN[0]=create_folder_py, IN[1]=id)  # IronPython2
# ---------- export2pdf_py.python (62 lines) ----------
# Phython-Standard- und DesignScript-Bibliotheken laden
import sys
import os
import clr
clr.AddReference('ProtoGeometry')
from Autodesk.DesignScript.Geometry import *

clr.AddReference("RevitNodes")
import Revit

clr.ImportExtensions(Revit.Elements)
clr.ImportExtensions(Revit.GeometryConversion)

clr.AddReference("RevitServices")
import RevitServices
from RevitServices.Persistence import DocumentManager 
from RevitServices.Transactions import TransactionManager 

# Import RevitAPI
clr.AddReference("RevitAPI")
import Autodesk
from Autodesk.Revit.DB import *

clr.AddReference('System')
#from System.Collections.Generic import *
from System.Collections.Generic import List

# Die Eingaben für diesen Block werden in Form einer Liste in den IN-Variablen gespeichert.
dataEnteringNode = IN

# Code unterhalb dieser Linie platzieren
###############################################################
# Current doc/app/ui
###############################################################
doc = DocumentManager.Instance.CurrentDBDocument
txt_filepath = IN[0][0]
do_create = IN[0][1]
viewId = IN[1]
	
def ExportPdf(id, folder, filename):
	options = PDFExportOptions()
	options.FileName = filename
	#options.TargetUnit = ExportUnit.Meter
	views = List[ElementId]()
	views.Add(ElementId(id))
	result = doc.Export(folder, views, options)
	return result

full_path = None
if not do_create and txt_filepath:
	folderPath = '\\'.join(txt_filepath.split('\\')[:-1])
	filename = txt_filepath.split('\\')[-1].replace('.txt', '')
	#filename = folderPath.split('__')[-1].split('\\')[-1]
	#filename = txt_folderpath.replace('.txt', '')
	
	assert not os.path.isfile(txt_filepath.replace('.txt', '.pdf')), '.dxf already exists!'
	
	ExportPdf(viewId, folderPath, filename)
	full_path = txt_filepath.replace('.txt', '.pdf')

#Assign your output to the OUT variable
OUT = full_path
# ----------------------------------------
save_to_txt_py = Python(IN[0]=create_corridor_end2end_py, IN[1]=create_folder_py)  # IronPython2
# ---------- save_to_txt_py.python (29 lines) ----------
# Phython-Standard- und DesignScript-Bibliotheken laden
import sys
import os
import clr
clr.AddReference('ProtoGeometry')
from Autodesk.DesignScript.Geometry import *

# Die Eingaben für diesen Block werden in Form einer Liste in den IN-Variablen gespeichert.
dataEnteringNode = IN
room_dict = IN[0]
txt_filepath = IN[1][0]

# Code unterhalb dieser Linie platzieren
if bool(room_dict) and txt_filepath:
	stdout_original = sys.stdout
	stdout_file = open(txt_filepath, 'w')
	sys.stdout = stdout_file
	
	for key in room_dict:
	    print key
	    for coord in room_dict[key]:
	        print "COORD_"+str(coord[0])+","+str(coord[1])
	    print ""
	
	sys.stdout = stdout_original
	stdout_file.close()

# Weisen Sie Ihre Ausgabe der OUT-Variablen zu.
OUT = [room_dict, txt_filepath]
# ----------------------------------------

watch_2 = Watch(export2dxf_py)
watch_3 = Watch(export2pdf_py)
watch_4 = Watch(save_to_txt_py)
watch_5 = Watch(create_folder_py)
watch_6 = Watch(create_corridor_end2end_py)
createFloorPlanWithOverlaidZones = BoolSelector(false)
exportViewAsTempPng = Python(IN[0]=id, IN[1]=createFloorPlanWithOverlaidZones)  # CPython3
# ---------- exportViewAsTempPng.python (37 lines) ----------
# IN[0] Element id of view

import clr
import System
from System.IO import *
clr.AddReference('ProtoGeometry')
from Autodesk.DesignScript.Geometry import *

clr.AddReference("RevitServices")
import RevitServices
from RevitServices.Persistence import DocumentManager 

clr.AddReference("RevitAPI")
from Autodesk.Revit.DB import *
import tempfile

if IN[1] : 
    doc = DocumentManager.Instance.CurrentDBDocument
    
    viewId = IN[0]
    elementId = ElementId(viewId)
    view = doc.GetElement(elementId)
    
    screenshot_of_view_path = tempfile.mktemp(suffix=".png")
    
    options = ImageExportOptions()
    options.ExportRange = ExportRange.CurrentView
    options.ViewName = view.Name
    options.FilePath = screenshot_of_view_path
    options.ZoomType = ZoomFitType.Zoom
    options.PixelSize = 2048
    
    doc.ExportImage(options)
    
    saved_image_path = f"{screenshot_of_view_path[:-3]}jpg" # Saving as JPG format (unusual behavior)
    
    OUT = saved_image_path
# ----------------------------------------
detectEdges = Python(IN[0]=exportViewAsTempPng, IN[1]=createFloorPlanWithOverlaidZones)  # CPython3
# ---------- detectEdges.python (35 lines) ----------
# IN[0] : path to temp jpg image of floor plan
import sys
sys.path.append(r'D:\Work\TUM_Research\HiWiPatrick\PedSimAutomation\DynamoDependencies\DynamoVEnv\lib\site-packages')
#sys.path.append(r'C:\Users\mohab\Documents\TUM\HiWiPatrick\PedSimAutomation\DynamoDependencies\DynamoVEnv\Lib\site-packages')
import cv2

def get_model_bbox(image_path):
    floor_plan_no_colors = cv2.imread(image_path)
    image_height , image_width , _ = floor_plan_no_colors.shape

    gray = cv2.cvtColor(floor_plan_no_colors, cv2.COLOR_BGR2GRAY)
    _, thresh = cv2.threshold(gray, 100, 255, cv2.THRESH_BINARY)

    contours, _ = cv2.findContours(thresh, cv2.RETR_TREE, cv2.CHAIN_APPROX_SIMPLE)
    contours = list(contours)
    contours.sort(key=cv2.contourArea , reverse=True)

    if not contours : 
        return None
        
    if len(contours) == 1 : 

        return [0 , 0 , image_width , image_height] , image_width , image_height

    # second largest contour is geometry (full image is largest)
    x, y, w, h = cv2.boundingRect(contours[1])
    bbox = [x , y , x + w , y + h]

    return bbox , image_width , image_height

if IN[1] : 
    image_path = IN[0]
    
    geometry_corners , image_width , image_height = get_model_bbox(image_path)
    OUT = geometry_corners , image_width , image_height
# ----------------------------------------
wallThickness = DoubleInput(0.3)
getScaledOriginsAndDestinations = Python(IN[0]=create_corridor_end2end_py, IN[1]=detectEdges, IN[2]=parameter_processing_py, IN[3]=wallThickness, IN[4]=createFloorPlanWithOverlaidZones)  # CPython3
# ---------- getScaledOriginsAndDestinations.python (61 lines) ----------
#IN[0]: room dict.
#IN[1]: bbox of geometry inside png
#IN[2]: site_x and site_y
#IN[3]: wall thickness in meters

import clr
from System.Drawing import *
from Autodesk.DesignScript.Geometry import *
from RevitServices.Persistence import DocumentManager 
from Autodesk.Revit.DB import *

def extract_lists_with_string(room_dict, type):
    extracted_lists = []
    for key in room_dict:
        if type in key:
            extracted_lists.append(room_dict[key])
    return extracted_lists

def flip_point_y_axis(point, height) :
    return height + 1 - point

def transform_to_image_coordinates(point , site_bbox_image , site_dims_revit , wall_thickness) : 
    transformed_point = []
    for c in range(len(point)) : 
        gradient = (site_bbox_image[c + 2] - site_bbox_image[c]) / site_dims_revit[c] # bbox: xmin,ymin,xmax,ymax
        if c == 0 :
            transformed_point.append(int(point[c] * gradient + site_bbox_image[c] + wall_thickness / 2 * gradient))
        else : 
            transformed_point.append(int(flip_point_y_axis(point[c] * gradient , site_bbox_image[c + 2] - site_bbox_image[c]) + site_bbox_image[c] - wall_thickness / 2 * gradient))

    return transformed_point

def transform_set_of_points(points , site_bbox_image , site_dims_revit , wall_thickness) : 
    transformed_points = []
    for point in points : 
        transformed_points.append(
            transform_to_image_coordinates(point , site_bbox_image , site_dims_revit , wall_thickness)
        )

    return transformed_points
    
if IN[4] : 
    
        
    dict = IN[0]
    site_bbox_in_image , image_width , image_height = IN[1]
    site_dimensions_revit = IN[2][1][:2]
    wall_thickness = IN[3]
    
    
    origins = extract_lists_with_string(dict , "ORIGIN")
    destinations = extract_lists_with_string(dict , "DESTINATION")
    
    origins_in_image = [
        transform_set_of_points(origin , site_bbox_in_image , site_dimensions_revit , wall_thickness) for origin in origins
    ]
    destinations_in_image = [
        transform_set_of_points(destination , site_bbox_in_image , site_dimensions_revit , wall_thickness) for destination in destinations
    ]
    
    OUT = origins_in_image , destinations_in_image
# ----------------------------------------
paddedimagewidth_int = DoubleInput(640)
paddedimageheight_int = DoubleInput(640)
createOverlaidAndPaddedImage = Python(IN[0]=detectEdges, IN[1]=getScaledOriginsAndDestinations, IN[2]=exportViewAsTempPng, IN[3]=createFloorPlanWithOverlaidZones, IN[4]=parameter_processing_py, IN[5]=paddedimagewidth_int, IN[6]=paddedimageheight_int)  # CPython3
# ---------- createOverlaidAndPaddedImage.python (91 lines) ----------
# IN[0] : bbox of geometry in image coordinate system, image width , image height
# IN[1] : origin and destination lists from origin and destination prepper script
# IN[2] : path of temp image created in script that runs before this one
# IN[3] : create input image or not (boolean)
# IN[4] : output of prepper script
# IN[5] : padded image width (input param)
# IN[6] : padded image height (input param)

import sys
sys.path.append(r'D:\Work\TUM_Research\HiWiPatrick\PedSimAutomation\DynamoDependencies\DynamoVEnv\lib\site-packages')
#sys.path.append(r'C:\Users\mohab\Documents\TUM\HiWiPatrick\PedSimAutomation\DynamoDependencies\DynamoVEnv\lib\site-packages')

import clr
import System
from System.IO import *
clr.AddReference('ProtoGeometry')
from Autodesk.DesignScript.Geometry import *

clr.AddReference("RevitServices")
import RevitServices
from RevitServices.Persistence import DocumentManager 

clr.AddReference("RevitAPI")
from Autodesk.Revit.DB import *

clr.AddReference('System.Drawing')
import System.Drawing
from System.Drawing import *
import os
import cv2
import numpy as np
import tempfile

def fix_open_cv_flipped_y(x_min_new, y_min_new, x_max_new, y_max_new):
    return x_min_new , y_max_new , x_max_new , y_min_new

def change_bounding_box_color(image, x_min, y_min, x_max, y_max, color):
    image[y_min:y_max, x_min:x_max] = tuple(color)

    return image

if IN[3] : 
    site_bbox_in_image = IN[0][0]
    origins, destinations = IN[1]
    image_path = IN[2]
    site_dimensions_meters = IN[4][1][:2]
    padded_image_width = int(IN[5])
    padded_image_height = int(IN[6])
    
    image = cv2.imread(image_path)

    origin_color = (0, 0, 255) #bgr
    destination_color = (0, 255, 0)
    
    # for origin in origins:
    #     reshaped_origin = [*origin[0], *origin[1]]
    #     pixel_coordinates = fix_open_cv_flipped_y(*reshaped_origin)
    #     image = change_bounding_box_color(image , *pixel_coordinates, origin_color)
    
    # for destination in destinations:
    #     reshaped_destination = [*destination[0], *destination[1]]
    #     pixel_coordinates = fix_open_cv_flipped_y(*reshaped_destination)
    #     image = change_bounding_box_color(image, *pixel_coordinates, destination_color)

    padded_image = np.zeros((padded_image_height, padded_image_width , 3), dtype=np.uint8)
    padded_image_centers = [
        int(dim / 2) for dim in [padded_image_width , padded_image_height]
    ]

    site_cutout = image[site_bbox_in_image[1] : site_bbox_in_image[3] , site_bbox_in_image[0] : site_bbox_in_image[2]]
    site_dims_in_padded_image = [
        dim * 10 for dim in site_dimensions_meters
    ]

    # using different interpolation order for upsizing and downsizing
    if site_dims_in_padded_image[0] > site_bbox_in_image[2] - site_bbox_in_image[0] and site_dims_in_padded_image[1] > site_bbox_in_image[3] - site_bbox_in_image[1] : 
        scaled_cutout = cv2.resize(site_cutout, tuple(site_dims_in_padded_image), interpolation=cv2.INTER_CUBIC)
    else : 
        scaled_cutout = cv2.resize(site_cutout, tuple(site_dims_in_padded_image), interpolation=cv2.INTER_AREA)

    origin_padded_image = [
        int(padded_image_centers[i] - site_dims_in_padded_image[i] / 2) for i in range(2)
    ]
    padded_image[origin_padded_image[1] : origin_padded_image[1] + site_dims_in_padded_image[1] , origin_padded_image[0] : origin_padded_image[0] + site_dims_in_padded_image[0]] = scaled_cutout
    
    overlayed_image_path = tempfile.mktemp(suffix=".png")
    cv2.imwrite(overlayed_image_path, padded_image)
    
    result = Image.FromFile(overlayed_image_path)
    
    OUT = result
# ----------------------------------------
inputForNN = WatchImageCore(image=createOverlaidAndPaddedImage)
wallThickness_2 = DoubleInput(0.75)
paddedimagewidth_int_2 = DoubleInput(640)
paddedimageheight_int_2 = DoubleInput(640)
virtual_environment_path = Directory("D:\Work\TUM_Research\HiWiPatrick\PedSimAutomation\DynamoDependencies\DynamoVEnv")
createFloorPlanWithOverlaidZones_2 = BoolSelector(true)
hide_elevation_arrows = Python(IN[0]=createFloorPlanWithOverlaidZones_2, IN[1]=id)  # CPython3
# ---------- hide_elevation_arrows.python (31 lines) ----------
import clr
clr.AddReference("RevitAPI")
from Autodesk.Revit.DB import *

clr.AddReference("RevitServices")
from RevitServices.Persistence import DocumentManager
from RevitServices.Transactions import TransactionManager

from System.Collections.Generic import List

doc = DocumentManager.Instance.CurrentDBDocument
TransactionManager.Instance.EnsureInTransaction(doc)

if UnwrapElement(IN[0]) : 
    viewId = IN[1]
    elementId = ElementId(viewId)
    view = doc.GetElement(elementId)

    elevationArrows = FilteredElementCollector(doc).OfCategory(BuiltInCategory.OST_Elev).ToElementIds()
    viewers = FilteredElementCollector(doc).OfCategory(BuiltInCategory.OST_Viewers).ToElementIds()
    
    if elevationArrows and viewers :
        view.HideElements(List[ElementId](elevationArrows))
        view.HideElements(List[ElementId](viewers))
        
        TransactionManager.Instance.TransactionTaskDone()
        
        OUT = 1
        
    else :
        OUT = 0
# ----------------------------------------
color_walls_black = Python(IN[0]=hide_elevation_arrows, IN[1]=id)  # CPython3
# ---------- color_walls_black.python (48 lines) ----------
#IN[0]: Create Floor plan or not (boolean)

import clr
clr.AddReference('ProtoGeometry')
from Autodesk.DesignScript.Geometry import *

clr.AddReference("RevitAPI")
from Autodesk.Revit.DB import *

clr.AddReference("RevitServices")
from RevitServices.Persistence import DocumentManager
from RevitServices.Transactions import TransactionManager

doc = DocumentManager.Instance.CurrentDBDocument

def OverrideColorPattern(element, color, pattern, view):
    graphicSettings = OverrideGraphicSettings()
    graphicSettings.SetSurfaceForegroundPatternColor(color)
    graphicSettings.SetCutForegroundPatternColor(color)
    graphicSettings.SetSurfaceForegroundPatternId(UnwrapElement(pattern).Id)
    graphicSettings.SetCutForegroundPatternId(UnwrapElement(pattern).Id)
    UnwrapElement(view).SetElementOverrides(element.Id, graphicSettings)

if UnwrapElement(IN[0]) : 
    viewId = IN[1]
    elementId = ElementId(viewId)
    view = doc.GetElement(elementId)

    black = Color(0, 0, 0)
    
    walls = FilteredElementCollector(doc).OfClass(Wall)
    TransactionManager.Instance.EnsureInTransaction(doc)
    
    fillPatterns = FilteredElementCollector(doc).OfClass(FillPatternElement)
    solidPattern = None
    for pattern in fillPatterns:
        if UnwrapElement(pattern).GetFillPattern().IsSolidFill:
            solidPattern = pattern
            break
    
    if solidPattern : 
        for wall in walls:
            OverrideColorPattern(wall, black, solidPattern, view)
    
        TransactionManager.Instance.TransactionTaskDone()
        OUT = 1
    else : 
        OUT = 0
# ----------------------------------------
get_rid_of_cropbox = Python(IN[0]=color_walls_black, IN[1]=id)  # CPython3
# ---------- get_rid_of_cropbox.python (24 lines) ----------
#IN[1]: view element id

import clr
clr.AddReference("RevitAPI")
from Autodesk.Revit.DB import *

clr.AddReference("RevitServices")
from RevitServices.Persistence import DocumentManager
from RevitServices.Transactions import TransactionManager

if UnwrapElement(IN[0]) : 
    doc = DocumentManager.Instance.CurrentDBDocument
    TransactionManager.Instance.EnsureInTransaction(doc)
    
    viewId = IN[1]
    elementId = ElementId(viewId)
    view = doc.GetElement(elementId)
    
    view.CropBoxActive = False
    view.CropBoxVisible = False
    
    TransactionManager.Instance.TransactionTaskDone()
    
    OUT = 1
# ----------------------------------------
show_floors_in_plan = Python(IN[0]=get_rid_of_cropbox, IN[1]=id)  # CPython3
# ---------- show_floors_in_plan.python (26 lines) ----------
import clr
clr.AddReference("RevitAPI")
from Autodesk.Revit.DB import *

clr.AddReference("RevitServices")
from RevitServices.Persistence import DocumentManager
from RevitServices.Transactions import TransactionManager

if UnwrapElement(IN[0]):
    doc = DocumentManager.Instance.CurrentDBDocument
    
    
    floorCategoryId = BuiltInCategory.OST_Floors
    
    
    activeView = doc.ActiveView
    
    
    floorCategory = Category.GetCategory(doc, floorCategoryId)
    
    
    TransactionManager.Instance.EnsureInTransaction(doc)
    activeView.SetCategoryHidden(floorCategory.Id, False)
    TransactionManager.Instance.TransactionTaskDone()
    
    OUT = 1
# ----------------------------------------
getScaledOriginsAndDestinations_2 = Python(IN[0]=create_corridor_end2end_py, IN[1]=detectEdges, IN[2]=parameter_processing_py, IN[3]=wallThickness, IN[4]=show_floors_in_plan)  # CPython3
# ---------- getScaledOriginsAndDestinations_2.python (62 lines) ----------
#IN[0]: room dict.
#IN[1]: bbox of geometry inside png
#IN[2]: site_x and site_y
#IN[3]: wall thickness in meters

import clr
from System.Drawing import *
from Autodesk.DesignScript.Geometry import *
from RevitServices.Persistence import DocumentManager 
from Autodesk.Revit.DB import *

def extract_lists_with_string(room_dict, type):
    extracted_lists = []
    for key in room_dict:
        if type in key:
            extracted_lists.append(room_dict[key])
    return extracted_lists

def flip_point_y_axis(point, height) :
    return height + 1 - point

def transform_to_image_coordinates(point , site_bbox_image , site_dims_revit , wall_thickness) : 
    transformed_point = []
    for c in range(len(point)) : 
        gradient = (site_bbox_image[c + 2] - site_bbox_image[c]) / site_dims_revit[c] # bbox: xmin,ymin,xmax,ymax
        if c == 0 :
            transformed_point.append(int(point[c] * gradient + site_bbox_image[c] + wall_thickness / 2 * gradient))
        else : 
            transformed_point.append(int(flip_point_y_axis(point[c] * gradient , site_bbox_image[c + 2] - site_bbox_image[c]) + site_bbox_image[c] - wall_thickness / 2 * gradient))

    return transformed_point

def transform_set_of_points(points , site_bbox_image , site_dims_revit , wall_thickness) : 
    transformed_points = []
    for point in points : 
        transformed_points.append(
            transform_to_image_coordinates(point , site_bbox_image , site_dims_revit , wall_thickness)
        )

    return transformed_points
    
if UnwrapElement(IN[4]) : 
    x = 1
        
    dict = IN[0]
    #site_bbox_in_image , image_width , image_height = IN[1]
    #site_dimensions_revit = IN[2][1][:2]
    #wall_thickness = IN[3]
    
    
    origins = extract_lists_with_string(dict , "ORIGIN")
    destinations = extract_lists_with_string(dict , "DESTINATION")
    
    # origins_in_image = [
    #     transform_set_of_points(origin , site_bbox_in_image , site_dimensions_revit , wall_thickness) for origin in origins
    # ]
    # destinations_in_image = [
    #     transform_set_of_points(destination , site_bbox_in_image , site_dimensions_revit , wall_thickness) for destination in destinations
    # ]
    
    #OUT = origins_in_image , destinations_in_image
    OUT = origins, destinations
# ----------------------------------------
overlayPlanWithColors = Python(IN[0]=getScaledOriginsAndDestinations_2, IN[1]=id)  # CPython3
# ---------- overlayPlanWithColors.python (103 lines) ----------
import clr
clr.AddReference("RevitAPI")
from Autodesk.Revit.DB import *

clr.AddReference("RevitServices")
from RevitServices.Persistence import DocumentManager
from RevitServices.Transactions import TransactionManager

doc = DocumentManager.Instance.CurrentDBDocument

def slab_geometry_by_level(x, y, level, delta_z , start_x , start_y):
    zz = level.Elevation + delta_z
    xx = x + start_x
    yy = y + start_y
    line_1 = Line.CreateBound(XYZ(start_x, start_y, zz), XYZ(xx, start_y, zz))
    line_2 = Line.CreateBound(XYZ(xx, start_y, zz), XYZ(xx, yy, zz))
    line_3 = Line.CreateBound(XYZ(xx, yy, zz), XYZ(start_x, yy, zz))
    line_4 = Line.CreateBound(XYZ(start_x, yy, zz), XYZ(start_x, start_y, zz))

    slab_geometry = CurveArray()
    slab_geometry.Append(line_1)
    slab_geometry.Append(line_2)
    slab_geometry.Append(line_3)
    slab_geometry.Append(line_4)
    return slab_geometry

def override_color_pattern(element, color, pattern, view):
    graphicSettings = OverrideGraphicSettings()
    graphicSettings.SetSurfaceForegroundPatternColor(color)
    graphicSettings.SetCutForegroundPatternColor(color)
    graphicSettings.SetSurfaceForegroundPatternId(UnwrapElement(pattern).Id)
    graphicSettings.SetCutForegroundPatternId(UnwrapElement(pattern).Id)
    graphicSettings.SetSurfaceBackgroundPatternId(UnwrapElement(pattern).Id)
    graphicSettings.SetCutBackgroundPatternId(UnwrapElement(pattern).Id)
    graphicSettings.SetProjectionLineColor(color)
    UnwrapElement(view).SetElementOverrides(element.Id, graphicSettings)

def convert_meter_to_unit(pre_value):
    tempo_list = []
    tempo_value = 0
    if isinstance(pre_value, list):
        len_list = len(pre_value)
        for ii in range(len_list):
            tempo_list.append (float(UnitUtils.ConvertToInternalUnits(pre_value[ii], UnitTypeId.Meters)))
        pre_value = tempo_list
    else:
        tempo_value = float(UnitUtils.ConvertToInternalUnits(pre_value, UnitTypeId.Meters))
        pre_value = tempo_value
    return pre_value

def create_colored_floor(length , width , start_x , start_y , level , doc , color) : 
    floor_geometry = slab_geometry_by_level(length, width, level, 1. , start_x , start_y)

    floor = doc.Create.NewFloor(floor_geometry, True)

    override_color_pattern(floor, color, solidPattern, view)


if IN[0] : 
    view_id = IN[1]
    element_id = ElementId(view_id)
    view = doc.GetElement(element_id)

    origins, destinations = IN[0]

    level = view.GenLevel

    TransactionManager.Instance.EnsureInTransaction(doc)

    fillPatterns = FilteredElementCollector(doc).OfClass(FillPatternElement)
    solidPattern = None
    for pattern in fillPatterns:
        if UnwrapElement(pattern).GetFillPattern().IsSolidFill:
            solidPattern = pattern
            break

    if solidPattern : 
        red = Color(255 , 0 , 0)
        green = Color(0 , 255 , 0)

        for origin in origins : 
            origin_bbox = convert_meter_to_unit([*origin[0], *origin[1]])

            start_x , start_y = origin_bbox[0] , origin_bbox[1]

            size_x = origin_bbox[2] - origin_bbox[0]
            size_y = origin_bbox[3] - origin_bbox[1]

            create_colored_floor(size_x , size_y , start_x , start_y , level , doc , red)
        for destination in destinations : 
            destination_bbox = convert_meter_to_unit([*destination[0], *destination[1]])

            start_x , start_y = destination_bbox[0] , destination_bbox[1]

            size_x = destination_bbox[2] - destination_bbox[0]
            size_y = destination_bbox[3] - destination_bbox[1]

            create_colored_floor(size_x , size_y , start_x , start_y , level , doc , green)

        TransactionManager.Instance.TransactionTaskDone()
        OUT = 1
    else : 
        OUT = 0
# ----------------------------------------
getPaddedImage = Python(IN[0]=id, IN[1]=overlayPlanWithColors)  # CPython3
# ---------- getPaddedImage.python (39 lines) ----------
# IN[0] Element id of view

import clr
import System
from System.IO import *
clr.AddReference('ProtoGeometry')
from Autodesk.DesignScript.Geometry import *

clr.AddReference("RevitServices")
import RevitServices
from RevitServices.Persistence import DocumentManager 

clr.AddReference("RevitAPI")
from Autodesk.Revit.DB import *
import tempfile

if UnwrapElement(IN[1]) : 
    doc = DocumentManager.Instance.CurrentDBDocument
    
    viewId = IN[0]
    elementId = ElementId(viewId)
    view = doc.GetElement(elementId)
    
    screenshot_of_view_path = tempfile.mktemp(suffix=".png")
    
    options = ImageExportOptions()
    options.ExportRange = ExportRange.CurrentView
    options.ViewName = view.Name
    options.FilePath = screenshot_of_view_path
    options.ZoomType = ZoomFitType.Zoom
    options.PixelSize = 2048
    
    doc.ExportImage(options)
    
    saved_image_path = f"{screenshot_of_view_path[:-3]}jpg" # Saving as JPG format (unusual behavior)
    
    image = 1
    
    OUT = saved_image_path , image
# ----------------------------------------
getImageAsBitmap = Python(IN[0]=getPaddedImage)  # CPython3
# ---------- getImageAsBitmap.python (24 lines) ----------
# IN[0] Element id of view

import clr
import System
from System.IO import *
clr.AddReference('ProtoGeometry')
from Autodesk.DesignScript.Geometry import *

clr.AddReference("RevitServices")
import RevitServices
from RevitServices.Persistence import DocumentManager 

clr.AddReference("RevitAPI")
from Autodesk.Revit.DB import *

clr.AddReference('System.Drawing')
import System.Drawing
from System.Drawing import *

if IN[0] : 
    result = Image.FromFile(IN[0][0])
    
    OUT = result
    
# ----------------------------------------
watch_image = WatchImageCore(image=getImageAsBitmap)
