# Dynamo graph testing.dyn (Dynamo 2.10.1.3976)

# group: Input parameters
SITE_X = DoubleSlider(25, range=20..60 step 5)  # graph input
SITE_Y = DoubleSlider(20, range=10..40 step 5)  # graph input
corridor_width = DoubleSlider(2, range=2..4 step 1)  # graph input
NUM_ROOMS_SHORT_SIDE = DoubleSlider(3, range=2..15 step 1)  # graph input
NUM_ROOMS_LONG_SIDE = DoubleSlider(3, range=2..15 step 1)  # graph input
INCLUDE_BOTTLENECK = BoolSelector(false)  # graph input

parameter_processing_py = Python(IN[0]=SITE_X, IN[1]=SITE_Y, IN[2]=corridor_width, IN[3]=NUM_ROOMS_SHORT_SIDE, IN[4]=NUM_ROOMS_LONG_SIDE, IN[5]=INCLUDE_BOTTLENECK)  # CPython3
# ---------- parameter_processing_py.python (25 lines) ----------
# Phython-Standard- und DesignScript-Bibliotheken laden
import sys
import os
import clr
clr.AddReference('ProtoGeometry')
from Autodesk.DesignScript.Geometry import *

# Die Eingaben für diesen Block werden in Form einer Liste in den IN-Variablen gespeichert.
dataEnteringNode = IN

# Code unterhalb dieser Linie platzieren
site_x = int(IN[0])                                # the overall length of the site
site_y = int(IN[1])                                # the overall widthness of the site
CORR_WIDTH = int(IN[2]) # convert_meter_to_unit(3)
NUM_ROOMS_SHORT_SIDE = int(IN[3])
NUM_ROOMS_LONG_SIDE = int(IN[4])
INCLUDE_BOTTLENECK = bool(IN[5])
#store_dir = IN[6]
#layout_name = IN[7]


txt_filename = \
    'floorplan_siteX_'+str(int(site_x))+'_siteY_'+str(int(site_y))+'_CORRWIDTH_'+str(CORR_WIDTH)+ '_NUMROOMS_'+str(NUM_ROOMS_SHORT_SIDE)+'_'+str(NUM_ROOMS_LONG_SIDE)+'_INCBNECK_'+str(INCLUDE_BOTTLENECK)+'.txt'
# Weisen Sie Ihre Ausgabe der OUT-Variablen zu.
OUT = txt_filename, [site_x, site_y, CORR_WIDTH, NUM_ROOMS_SHORT_SIDE, NUM_ROOMS_LONG_SIDE, INCLUDE_BOTTLENECK]
# ----------------------------------------

# group: Settings
true_create_building_false = BoolSelector(true)  # "True== Create Building // False==Export Floorplan"; graph input
directory_path = Directory("C:\Users\ga78jem\Documents\Revit\Exports_EGICE")
create_folder_structure = BoolSelector(false)  # graph input

string = StringInput("corr_e2e")
create_folder_py = Python(IN[0]=parameter_processing_py, IN[1]=true_create_building_false, IN[2]=directory_path, IN[3]=string, IN[4]=create_folder_structure)  # IronPython2; graph output
# ---------- create_folder_py.python (59 lines) ----------
# Phython-Standard- und DesignScript-Bibliotheken laden
import sys
import clr
clr.AddReference('ProtoGeometry')
from Autodesk.DesignScript.Geometry import *
import os
import shutil

clr.AddReference("RevitServices")
import RevitServices
from RevitServices.Persistence import DocumentManager 
doc = DocumentManager.Instance.CurrentDBDocument

# Die Eingaben für diesen Block werden in Form einer Liste in den IN-Variablen gespeichert.
dataEnteringNode = IN

# Code unterhalb dieser Linie platzieren

txt_filename = IN[0][0]
do_create = IN[1]
store_dir = IN[2]
layout_name = str(IN[3])
create_folder_structure = IN[4]

new_folder_name = None
txt_filepath = None

if create_folder_structure:

	dataset_folder_name = os.path.join(store_dir, layout_name)
	if not os.path.isdir(dataset_folder_name): os.mkdir(dataset_folder_name)
	
	new_folder_name = txt_filename.replace('.txt', '')
	# only check for duplicate settings when creating a new subfolder corresponding to the settings
	prefix = None
	if do_create:
		if len(os.listdir(dataset_folder_name)) > 0:
			for dirname in os.listdir(dataset_folder_name):
				assert new_folder_name != dirname.split('__')[-1], 'Duplicate settings!'
		prefix = str(len(os.listdir(dataset_folder_name)))+'__'
	
	elif not do_create:
		for dirname in os.listdir(dataset_folder_name):
			if new_folder_name == dirname.split('__')[-1]:
				prefix = dirname.split('__')[0] + '__'
	
	assert prefix, 'folder prefix is empty or doesnt exist, probably because a folder does not exist'
	new_folder_name = prefix+new_folder_name
	new_folder_name = os.path.join(dataset_folder_name, new_folder_name)
	
	# dont create the folder when exporting (it should already be there from the previous step...
	if do_create:
		os.mkdir(new_folder_name)
	#shutil.move(txt_filename, new_folder_name)
	txt_filepath = os.path.join(new_folder_name, txt_filename)

#doc.Regenerate()
# Weisen Sie Ihre Ausgabe der OUT-Variablen zu.
OUT = txt_filepath, do_create
# ----------------------------------------

# group: Floorplan View
element_types = ElementTypes("ViewPlan")
all_elements_of_type = ElementsOfType(element_type=element_types)
watch = Watch(all_elements_of_type)
viewplan_selector = CodeBlock(IN=watch) { OUT=IN[0]; }
id = Element.Id(element=viewplan_selector)

# group: Wall & Floor Types
default_exterior_wall_types = WallTypes("Generic - 300mm")
default_floor_types = FloorTypes("Generic 150mm - Filled")
default_interior_wall_types = WallTypes("Generic - 200mm")

door_width = DoubleInput(0.915)
obstacle_width = DoubleInput(0.8)
create_corridor_end2end_py = Python(IN[0]=default_exterior_wall_types, IN[1]=default_floor_types, IN[2]=default_interior_wall_types, IN[3]=parameter_processing_py, IN[4]=true_create_building_false, IN[5]=door_width, IN[6]=obstacle_width)  # CPython3
# ---------- create_corridor_end2end_py.python (551 lines) ----------
###############################################################
# Load the Libraries
###############################################################
import os
import clr
import sys
import math
import System

from System import Array
from System.Collections.Generic import *

clr.AddReference("RevitNodes")
import Revit

clr.ImportExtensions(Revit.Elements)
clr.ImportExtensions(Revit.GeometryConversion)

clr.AddReference("RevitServices")
import RevitServices
from RevitServices.Persistence import DocumentManager 
from RevitServices.Transactions import TransactionManager 

clr.AddReference("RevitAPI")
clr.AddReference("RevitAPIUI")

clr.AddReference('ProtoGeometry')
import Autodesk 
from Autodesk.DesignScript.Geometry import *
from Autodesk.Revit.DB import *
#from Autodesk.Revit.UI import *
from Autodesk.Revit.DB import StairsEditScope
from Autodesk.Revit.DB import Parameter
from Autodesk.Revit.DB.Architecture import StairsRun
from Autodesk.Revit.DB.Architecture import *
from Autodesk.Revit.DB import IFailuresPreprocessor

###############################################################
# Customize functions 
###############################################################
"""
Converts default unit in Dynamo into meter...
"""
def convert_meter_to_unit(pre_value):
    tempo_list = []
    tempo_value = 0
    if isinstance(pre_value, list):
        len_list = len(pre_value)
        for ii in range(len_list):
            tempo_list.append (float(UnitUtils.ConvertToInternalUnits(pre_value[ii], UnitTypeId.Meters)))
        pre_value = tempo_list
    else:
        tempo_value = float(UnitUtils.ConvertToInternalUnits(pre_value, UnitTypeId.Meters))
        pre_value = tempo_value
    return pre_value


def convert_to_meter(internal_value):
	if isinstance(internal_value, list):
		return [UnitUtils.ConvertFromInternalUnits(value, UnitTypeId.Meters) for value in internal_value]
	return float(UnitUtils.ConvertFromInternalUnits(internal_value, UnitTypeId.Meters))

"""
Provide perimeter lines from three dimensions...
"""
def find_perimeter_lines(x,y,z):
    line_list = []
    xx = x
    yy = y
    zz = z 
    # print "find_perimeter_lines x: " + str(x)
    # print "find_perimeter_lines y: " + str(y)
    # print "find_perimeter_lines z: " + str(z)
	
    line_1 = Autodesk.Revit.DB.Line.CreateBound(XYZ(0,0,zz),    XYZ(xx,0,zz))
    line_2 = Autodesk.Revit.DB.Line.CreateBound(XYZ(xx,0,zz),   XYZ(xx,yy,zz))
    line_3 = Autodesk.Revit.DB.Line.CreateBound(XYZ(xx,yy,zz),  XYZ(0,yy,zz))
    line_4 = Autodesk.Revit.DB.Line.CreateBound(XYZ(0,yy,zz),   XYZ(0,0,zz))

    line_list.append(line_1)
    line_list.append(line_2)
    line_list.append(line_3)
    line_list.append(line_4)
    
    return line_list

"""
Provide the geometry of slab by level...
"""
def slab_geometry_by_level(x,y,level,delta_z):
    zz = level.Elevation + delta_z
    xx = x
    yy = y 
    line_1 = Autodesk.Revit.DB.Line.CreateBound(XYZ(0,0,zz),    XYZ(xx,0,zz))
    line_2 = Autodesk.Revit.DB.Line.CreateBound(XYZ(xx,0,zz),   XYZ(xx,yy,zz))
    line_3 = Autodesk.Revit.DB.Line.CreateBound(XYZ(xx,yy,zz),  XYZ(0,yy,zz))
    line_4 = Autodesk.Revit.DB.Line.CreateBound(XYZ(0,yy,zz),   XYZ(0,0,zz))
    
    slab_geometry = CurveArray()
    slab_geometry.Append(line_1)
    slab_geometry.Append(line_2)
    slab_geometry.Append(line_3)
    slab_geometry.Append(line_4)
    return slab_geometry

###############################################################
# Current doc/app/ui
###############################################################
doc = DocumentManager.Instance.CurrentDBDocument
# uiapp = DocumentManager.Instance.CurrentUIApplication 
# app = uiapp.Application
# uidoc = uiapp.ActiveUIDocument

###############################################################
# Prepare the input
###############################################################
default_exterior_wall_type = UnwrapElement(IN[0])                   # Default exterior wall type
default_floor_type = UnwrapElement(IN[1])                           # Default Floor type
default_interior_wall_type = UnwrapElement(IN[2])				# Default interior wall type
### INPUT PARAMETERS ###
parameter_list = IN[3][1]
site_x = parameter_list[0]                                # the overall length of the site
site_y = parameter_list[1]                                # the overall widthness of the site
CORR_WIDTH = parameter_list[2] # convert_meter_to_unit(3)
NUM_ROOMS_SHORT_SIDE = parameter_list[3]
NUM_ROOMS_LONG_SIDE = parameter_list[4]
USE_BOTTLENECKS = parameter_list[5]

create_mode = IN[4]
DOOR_WIDTH_H = convert_meter_to_unit(float(IN[5])/2.)
OBSTACLE_WIDTH = float(IN[6])

number_story = 1                                          # the total amount of the stories;
story_z = [0]
site_z = 4                                              # the overall height of the site
ref_level_z = 0                                         # the z-position of the reference level (default level = level 0, created in the prepared .rvt)
###############################################################
# Transaction in Revit
###############################################################
TransactionManager.Instance.EnsureInTransaction(doc)
###############################################################
# Define the output
###############################################################

# Create room dict
room_dict = {}

if create_mode:
    geo_site = []                                                       # archive all the input data
    ref_level = []                                                      # the reference level
    bbox_site = []                                                      # bounding box of the site

    # sys.path.append('C:\Users\ga78jem\Miniconda3\envs\trajectron++\Lib\site-packages')

    ###############################################################
    # Convert the Units | b = UnitUtils.ConvertToInternalUnits(a, UnitTypeId.Meters)  b = a*3 | c = UnitUtils.ConvertFromInternalUnits(a, UnitTypeId.Meters)  c = a*3
    ###############################################################

    # print "site x before conversion:" + str(site_x)
    # adjust the sizes to account for wall thickness
    site_x -= 0.3
    site_y -= 0.3
    site_x = convert_meter_to_unit(site_x)
    site_y = convert_meter_to_unit(site_y)
    site_z = convert_meter_to_unit(site_z)
    ref_level_z = convert_meter_to_unit(ref_level_z)
    CORR_WIDTH = convert_meter_to_unit(CORR_WIDTH)
    # print "site x after conversion:" + str(site_x)

    ###############################################################
    # Delete all levels apart from the reference level (when there are multiple levels)
    ###############################################################
    # Collect all levels
    levelArray = (FilteredElementCollector(doc)
        .OfCategory(BuiltInCategory.OST_Levels)
        .WhereElementIsNotElementType()
        .ToElements())

    def clear_model(bool_value):
        if bool_value:
            del_grid = FilteredElementCollector(doc).OfCategory(BuiltInCategory.OST_Grids).WhereElementIsNotElementType().ToElements()
            del_door = FilteredElementCollector(doc).OfCategory(BuiltInCategory.OST_Doors).WhereElementIsNotElementType().ToElements()
            del_floor = FilteredElementCollector(doc).OfCategory(BuiltInCategory.OST_Floors).WhereElementIsNotElementType().ToElements()
            del_wall = FilteredElementCollector(doc).OfCategory(BuiltInCategory.OST_Walls).WhereElementIsNotElementType().ToElements()
            del_roof = FilteredElementCollector(doc).OfCategory(BuiltInCategory.OST_Roofs).WhereElementIsNotElementType().ToElements()
            del_all = [del_grid, del_door, del_floor, del_wall, del_roof]
            for element_type in del_all:
                for element in element_type:
                    doc.Delete(element.Id)

    clear_model(True)

    # Check the number of the existing levels, if multiple, delete and save only one
    if len(levelArray) > 1:
        #print "levelArray.Count > 1, from 01_Site"
        for levelElement in levelArray:
            if levelElement.Elevation != ref_level_z:
                doc.Delete(levelElement.Id)
    ref_level = levelArray[0]
    ref_level.Name = "Story Level 0"

    # Check the if the saved one is the reference level, correct it if not
    if ref_level.Elevation != ref_level_z:
        ref_level_new = Autodesk.Revit.DB.Level.Create(doc, ref_level_z)
        doc.Delete(ref_level.Id)
        ref_level = ref_level_new
        ref_level.Name = "Story Level 0"

    #--------------------------------------------------------------
    #------------------ OK NOW YOU CAN CODE -----------------------
    #--------------------------------------------------------------

    # Create Bounding Box
    bb = BoundingBoxXYZ()
    bb.Min = XYZ(0, 0, 0)
    bb.Max = XYZ(0, 0, site_z)
    bbox_site.append(bb.ToProtoType())                  # the bounding box of the entire site
    # Close and save the recording file
    # geo_site.append(site_x)
    # geo_site.append(site_y)
    # geo_site.append(site_z)

    ###############################################################
    # END OF SCRIPT 1
    # START OF SCRIPT 2
    ###############################################################

    archive_data = []                                                   # archive all the input data
    bbox_story = []
    exterior_wall_list = []
    floor_list = []
    roof_list = []
    entrance_door_list = []

    ###############################################################
    # Convert the Units | b = UnitUtils.ConvertToInternalUnits(a, UnitTypeId.Meters)  b = a*3 | c = UnitUtils.ConvertFromInternalUnits(a, UnitTypeId.Meters)  c = a*3
    ###############################################################
    story_z = convert_meter_to_unit(story_z)

    # Collect all levels
    levelArray = (FilteredElementCollector(doc)
        .OfCategory(BuiltInCategory.OST_Levels)
        .WhereElementIsNotElementType()
        .ToElements())

    # Check the number of the existing levels, if multiple, delete and save only one
    if len(levelArray) > 1:
        #print "levelArray.Count > 1, from 02_Story"
        for levelElement in levelArray:
            if levelElement.Elevation != ref_level.Elevation:
                doc.Delete(levelElement.Id)
    ref_level = levelArray[0]
    ref_level.Name = "Story Level 0"

    # Check the if the saved one is the reference level, correct it if not
    if ref_level.Elevation != 0:
        ref_level_new = Autodesk.Revit.DB.Level.Create(doc, 0)
        doc.Delete(ref_level.Id)
        ref_level = ref_level_new
        ref_level.Name = "Story Level 0"

    ###############################################################
    # Check the consistence with the bouning box of the side 
    ###############################################################
    # Check the z-position of the highest story against the site box

    check_site_story = True if max(story_z) < site_z else False
    #print "The stories are consistent with the overal site:" + str(check_site_story)

    # Create new story levels
    for ii in range(number_story):
        if ref_level.Elevation == story_z[ii]:
            continue
        new_level = Autodesk.Revit.DB.Level.Create(doc, story_z[ii])
        new_level.Name = "Story Level " + str(ii)

    # Create the roof level
    roof_level = Autodesk.Revit.DB.Level.Create(doc, site_z)
    roof_level.Name = "Roof Level"

    # all levels
    allLevels = FilteredElementCollector(doc).OfClass(Level).ToElements()

    # Create Bounding Box for each story level
    for ii in range(number_story):
        level_bbox_end_z = story_z[ii+1] if ii < (number_story-1) else site_z
        #print "Story"+str(ii)
        #print str(level_bbox_end_z)
        bb = BoundingBoxXYZ()
        bb.Min = XYZ(0, 0, story_z[ii])
        bb.Max = XYZ(site_x, site_y, level_bbox_end_z)
        bbox_story.append(bb.ToProtoType())

    ##############################################################################################################################
    ##############################################################################################################################
    # Create floorplan complexity
    ##############################################################################################################################
    ##############################################################################################################################

    WIDTH = site_y
    LENGTH = site_x
    print('x_length: ' + str(convert_to_meter(LENGTH)))
    print('y_width: ' + str(convert_to_meter(WIDTH)))
    print("")
    z_level = ref_level.Elevation
    ceiling = allLevels[0].Elevation

    obstacle_counter = 0

    # Create the exterior walls
    perimeter_lines = find_perimeter_lines(LENGTH, WIDTH, z_level)
    for ww in range(4):
        wall = Wall.Create(doc, perimeter_lines[ww], default_exterior_wall_type.Id, ref_level.Id, site_z, 0, False, True)
        exterior_wall_list.append(wall)

    # Create floor for each story level
    for ii in range(number_story):
        ll = allLevels[ii]
        floor_geometry = slab_geometry_by_level(LENGTH, WIDTH, ll, 0.0)
        floor = doc.Create.NewFloor(floor_geometry, default_floor_type, ll, True)
        floor_list.append(floor)

    # Create corridor lines
    y_main_corridor = 0.5*WIDTH
    x_main_corridor_start = 1.5*CORR_WIDTH
    x_main_corridor_end = LENGTH-1.5*CORR_WIDTH
        
    bottlneck_ys = [CORR_WIDTH, WIDTH-CORR_WIDTH]

    P0_long = XYZ(x_main_corridor_start, 0, ceiling)
    P1_long = XYZ(x_main_corridor_start, y_main_corridor - CORR_WIDTH/2., ceiling)
    P2_long = XYZ(LENGTH, y_main_corridor - CORR_WIDTH/2., ceiling)

    line_corr_0_long = Autodesk.Revit.DB.Line.CreateBound(P0_long, P1_long)
    line_corr_1_long = Autodesk.Revit.DB.Line.CreateBound(P1_long, P2_long)

    P1_short = XYZ(0, y_main_corridor + CORR_WIDTH/2., ceiling)
    P2_short = XYZ(x_main_corridor_end, y_main_corridor + CORR_WIDTH/2., ceiling)
    P3_short = XYZ(x_main_corridor_end, WIDTH, ceiling)
    
    line_corr_1_short = Autodesk.Revit.DB.Line.CreateBound(P1_short, P2_short)
    line_corr_2_short = Autodesk.Revit.DB.Line.CreateBound(P2_short, P3_short)

    corr_room_lines = [line_corr_1_short, line_corr_2_short, line_corr_0_long, line_corr_1_long] # , line_corr_2_long, line_corr_3_long]
    # Create corridor-room walls
    corr_walls = [Wall.Create(doc, wall_line, default_interior_wall_type.Id, allLevels[0].Id, allLevels[1].Elevation - allLevels[0].Elevation, 0, False, True) \
        for wall_line in corr_room_lines]

    # obstacles
    obstacle_length = 1.

    x_obst_min, x_obst_max = convert_to_meter(x_main_corridor_end)+0.1, convert_to_meter(x_main_corridor_end)+0.1+obstacle_length
    y_obst_min, y_obst_max = convert_to_meter(y_main_corridor + CORR_WIDTH/2.)+0.5, convert_to_meter(y_main_corridor + CORR_WIDTH/2.)+0.5+OBSTACLE_WIDTH
    room_dict.update({
        'CROWDIT_OBSTACLE_'+str(obstacle_counter)+'_1_1_': [
                (x_obst_min, y_obst_min),
                (x_obst_max, y_obst_max)
            ]
        }
    )
    obstacle_counter += 1

    x_obst_min, x_obst_max = convert_to_meter(x_main_corridor_start)-0.1-obstacle_length, convert_to_meter(x_main_corridor_start)-0.1
    y_obst_min, y_obst_max = convert_to_meter(y_main_corridor - CORR_WIDTH/2.)-0.5-OBSTACLE_WIDTH, convert_to_meter(y_main_corridor - CORR_WIDTH/2.)-0.5
    room_dict.update({
        'CROWDIT_OBSTACLE_'+str(obstacle_counter)+'_1_1_': [
                (x_obst_min, y_obst_min),
                (x_obst_max, y_obst_max)
            ]
        }
    )
    obstacle_counter += 1
    

    # destination areas
    bottlneck_ys_room_dict = [0, WIDTH]
    origin_opening_list = []
    
    x_min_fixed_1, x_max_fixed_1 = min(0, x_main_corridor_start), max(0, x_main_corridor_start)
    y_min_fixed_1, y_max_fixed_1 = min(bottlneck_ys[0], bottlneck_ys_room_dict[0]), max(bottlneck_ys[0], bottlneck_ys_room_dict[0])

    room_dict.update({
        'CROWDIT_DESTINATION_0': [
                (convert_to_meter(x_min_fixed_1)+0.5, convert_to_meter(y_min_fixed_1)+0.5),
                (convert_to_meter(x_max_fixed_1)-0.5, convert_to_meter(y_max_fixed_1)-0.5)
            ]
        }
    )

    x_min_fixed_2, x_max_fixed_2 = min(x_main_corridor_end, LENGTH), max(x_main_corridor_end, LENGTH)
    y_min_fixed_2, y_max_fixed_2 = min(bottlneck_ys[1], bottlneck_ys_room_dict[1]), max(bottlneck_ys[1], bottlneck_ys_room_dict[1])

    room_dict.update({
        'CROWDIT_DESTINATION_1': [
                (convert_to_meter(x_min_fixed_2)+0.5, convert_to_meter(y_min_fixed_2)+0.5),
                (convert_to_meter(x_max_fixed_2)-0.5, convert_to_meter(y_max_fixed_2)-0.5)
            ]
        }
    )

    ###############
    # Office rooms
    ###############
    # DOOR_WIDTH_H = convert_meter_to_unit(0.5)
    DOOR_HEIGHT = convert_meter_to_unit(2.2)
    DOOR_THICKNESS_H = convert_meter_to_unit(0.25)

    # short side
    fractions = [1./(NUM_ROOMS_SHORT_SIDE)*i for i in range(NUM_ROOMS_SHORT_SIDE+1)]
    short_x_coord_list = [P1_short[0] + fr * (P2_short[0] - P1_short[0]) for fr in fractions]
    
    for x_coord in short_x_coord_list[1:-1]:
        office_office_line = Autodesk.Revit.DB.Line.CreateBound(
                XYZ(x_coord, P2_short[1], ceiling),
                XYZ(x_coord, P3_short[1], ceiling))
        Wall.Create(doc, office_office_line, default_interior_wall_type.Id, allLevels[0].Id, allLevels[1].Elevation - allLevels[0].Elevation, 0, False, True)
    
    # create openings short offices
    for id in range(len(short_x_coord_list)-1):
        x_opening = (short_x_coord_list[id+1] + short_x_coord_list[id])/2.
        y_opening = P1_short[1]
        z_opening = z_level

        start_point = XYZ(x_opening-DOOR_WIDTH_H, y_opening-DOOR_THICKNESS_H, z_opening)
        end_point = XYZ(x_opening+DOOR_WIDTH_H, y_opening+DOOR_THICKNESS_H, z_opening+DOOR_HEIGHT)
        origin_opening_list.append(doc.Create.NewOpening(corr_walls[0], start_point, end_point))

        y_min_var_short, y_max_var_short = min(P1_short[1], P3_short[1]), max(P1_short[1], P3_short[1])

        room_dict.update({
            'CROWDIT_ORIGIN_'+str(id): [
                    (convert_to_meter(short_x_coord_list[id])+0.5, convert_to_meter(y_min_var_short)+0.5),
                    (convert_to_meter(short_x_coord_list[id+1])-0.5, convert_to_meter(y_max_var_short)-0.5)
                ]
            }
        )

        if id > 0:
            # obstacle: rectangle (e.g. table: 2x1 m rectangle)
            obstacle_length = 2.
            if y_opening < y_main_corridor:
                y_obst_min = convert_to_meter(y_opening)+0.1
                y_obst_max = convert_to_meter(y_opening)+0.1+OBSTACLE_WIDTH
            else:
                y_obst_min = convert_to_meter(y_opening)-0.1-OBSTACLE_WIDTH
                y_obst_max = convert_to_meter(y_opening)-0.1

            room_dict.update({
                'CROWDIT_OBSTACLE_'+str(obstacle_counter)+'_2_1_': [
                        (convert_to_meter(short_x_coord_list[id])-obstacle_length/2., y_obst_min),
                        (convert_to_meter(short_x_coord_list[id])+obstacle_length/2., y_obst_max)
                    ]
                }
            )
            obstacle_counter += 1


    # long side
    # create openings long offices
    fractions = [1./(NUM_ROOMS_LONG_SIDE)*i for i in range(NUM_ROOMS_LONG_SIDE+1)]
    long_x_coord_list = [P1_long[0] + fr * (P2_long[0] - P1_long[0]) for fr in fractions]

    for x_coord in long_x_coord_list[1:-1]:
        office_office_line = Autodesk.Revit.DB.Line.CreateBound(
                XYZ(x_coord, P2_long[1], ceiling),
                XYZ(x_coord, P0_long[1], ceiling))
        Wall.Create(doc, office_office_line, default_interior_wall_type.Id, allLevels[0].Id, allLevels[1].Elevation - allLevels[0].Elevation, 0, False, True)

    
    # create openings long offices
    for id in range(len(long_x_coord_list[:-1])):
        x_opening = (long_x_coord_list[id+1] + long_x_coord_list[id])/2.
        y_opening = P1_long[1]
        z_opening = z_level

        start_point = XYZ(x_opening-DOOR_WIDTH_H, y_opening-DOOR_THICKNESS_H, z_opening)
        end_point = XYZ(x_opening+DOOR_WIDTH_H, y_opening+DOOR_THICKNESS_H, z_opening+DOOR_HEIGHT)
        origin_opening_list.append(doc.Create.NewOpening(corr_walls[3], start_point, end_point))

        y_min_var_long, y_max_var_long = min(P0_long[1], P1_long[1]), max(P0_long[1], P1_long[1])
        room_dict.update({
            'CROWDIT_ORIGIN_'+str(id+len(short_x_coord_list)-1): [
                    (convert_to_meter(long_x_coord_list[id])+0.5, convert_to_meter(y_min_var_long)+0.5),
                    (convert_to_meter(long_x_coord_list[id+1])-0.5, convert_to_meter(y_max_var_long)-0.5)
                ]
            }
        )

        if id > 0:
            # obstacle: rectangle (e.g. table: 2x1 m rectangle)
            obstacle_length = 2.
            if y_opening < y_main_corridor:
                y_obst_min = convert_to_meter(y_opening)+0.1
                y_obst_max = convert_to_meter(y_opening)+0.1+OBSTACLE_WIDTH
            else:
                y_obst_min = convert_to_meter(y_opening)-0.1-OBSTACLE_WIDTH
                y_obst_max = convert_to_meter(y_opening)-0.1

            room_dict.update({
                'CROWDIT_OBSTACLE_'+str(obstacle_counter)+'_2_1_': [
                        (convert_to_meter(long_x_coord_list[id])-obstacle_length/2., y_obst_min),
                        (convert_to_meter(long_x_coord_list[id])+obstacle_length/2., y_obst_max)
                    ]
                }
            )
            obstacle_counter += 1


    if USE_BOTTLENECKS:
        bottleneck_lines = [
            Autodesk.Revit.DB.Line.CreateBound(
                XYZ(0, bottlneck_ys[0], ceiling),
                XYZ(x_main_corridor_start, bottlneck_ys[0], ceiling)),
            
            Autodesk.Revit.DB.Line.CreateBound(
                XYZ(x_main_corridor_end, bottlneck_ys[1], ceiling),
                XYZ(LENGTH, bottlneck_ys[1], ceiling))
        ]
        
        bottleneck_walls = [Wall.Create(doc, line, default_interior_wall_type.Id, allLevels[0].Id, allLevels[1].Elevation - allLevels[0].Elevation, 0, False, True)
            for line in bottleneck_lines]

        # some doors
        x_opening_1 = x_main_corridor_start/2.
        y_opening_1 = bottlneck_ys[0]
        z_opening_1 = z_level

        start_point_1 = XYZ(x_opening_1-DOOR_WIDTH_H, y_opening_1-DOOR_THICKNESS_H, z_opening_1)
        end_point_1 = XYZ(x_opening_1+DOOR_WIDTH_H, y_opening_1+DOOR_THICKNESS_H, z_opening+DOOR_HEIGHT)
        opening_1 = doc.Create.NewOpening(bottleneck_walls[0], start_point_1, end_point_1)

        x_opening_2 = x_main_corridor_end + (LENGTH-x_main_corridor_end)/2.
        y_opening_2 = bottlneck_ys[1]
        z_opening_2 = z_level

        start_point_2 = XYZ(x_opening_2-DOOR_WIDTH_H, y_opening_2-DOOR_THICKNESS_H, z_opening_2)
        end_point_2 = XYZ(x_opening_2+DOOR_WIDTH_H, y_opening_2+DOOR_THICKNESS_H, z_opening_2+DOOR_HEIGHT)
        opening_2 = doc.Create.NewOpening(bottleneck_walls[1], start_point_2, end_point_2)

    assert len(origin_opening_list) == len([key for key in room_dict if key.startswith('CROWDIT_ORIGIN_')])
    
#--------------------------------------------------------------
#------------------ OK NOW END THE CODE -----------------------
#--------------------------------------------------------------

TransactionManager.Instance.TransactionTaskDone()

###############################################################
# Prepare the output 
###############################################################
OUT = room_dict # , len([key for key in room_dict if key.startswith('CROWDIT_OBSTACLE_')])
# ----------------------------------------

# group: Export
export2dxf_py = Python(IN[0]=create_folder_py, IN[1]=id)  # IronPython2
# ---------- export2dxf_py.python (59 lines) ----------
# Phython-Standard- und DesignScript-Bibliotheken laden
import sys
import os
import clr
clr.AddReference('ProtoGeometry')
from Autodesk.DesignScript.Geometry import *

clr.AddReference("RevitNodes")
import Revit

clr.ImportExtensions(Revit.Elements)
clr.ImportExtensions(Revit.GeometryConversion)

clr.AddReference("RevitServices")
import RevitServices
from RevitServices.Persistence import DocumentManager 
from RevitServices.Transactions import TransactionManager 

# Import RevitAPI
clr.AddReference("RevitAPI")
import Autodesk
from Autodesk.Revit.DB import *

clr.AddReference('System')
#from System.Collections.Generic import *
from System.Collections.Generic import List

# Die Eingaben für diesen Block werden in Form einer Liste in den IN-Variablen gespeichert.
dataEnteringNode = IN

# Code unterhalb dieser Linie platzieren
###############################################################
# Current doc/app/ui
###############################################################
doc = DocumentManager.Instance.CurrentDBDocument

txt_filepath = IN[0][0]
do_create = IN[0][1]
viewId = IN[1]

def ExportDxf(name, id, folder, filename):
	options = DXFExportOptions()
	options.TargetUnit = ExportUnit.Meter
	views = List[ElementId]()
	views.Add(ElementId(id))
	result = doc.Export(folder, name, views, options)
	return result

fullpath = None
if not do_create and txt_filepath: 
	folderPath = '\\'.join(txt_filepath.split('\\')[:-1])
	filename = txt_filepath.split('\\')[-1].replace('.txt', '.dxf')
	
	assert not os.path.isfile(os.path.join(folderPath, filename)), '.dxf already exists!'
	ExportDxf(filename, viewId, folderPath, filename)
	fullpath = txt_filepath.replace('.txt', '.dxf')

#Assign your output to the OUT variable
OUT = fullpath
# ----------------------------------------
export2pdf_py = Python(IN[0]=create_folder_py, IN[1]=id)  # IronPython2
# ---------- export2pdf_py.python (62 lines) ----------
# Phython-Standard- und DesignScript-Bibliotheken laden
import sys
import os
import clr
clr.AddReference('ProtoGeometry')
from Autodesk.DesignScript.Geometry import *

clr.AddReference("RevitNodes")
import Revit

clr.ImportExtensions(Revit.Elements)
clr.ImportExtensions(Revit.GeometryConversion)

clr.AddReference("RevitServices")
import RevitServices
from RevitServices.Persistence import DocumentManager 
from RevitServices.Transactions import TransactionManager 

# Import RevitAPI
clr.AddReference("RevitAPI")
import Autodesk
from Autodesk.Revit.DB import *

clr.AddReference('System')
#from System.Collections.Generic import *
from System.Collections.Generic import List

# Die Eingaben für diesen Block werden in Form einer Liste in den IN-Variablen gespeichert.
dataEnteringNode = IN

# Code unterhalb dieser Linie platzieren
###############################################################
# Current doc/app/ui
###############################################################
doc = DocumentManager.Instance.CurrentDBDocument
txt_filepath = IN[0][0]
do_create = IN[0][1]
viewId = IN[1]
	
def ExportPdf(id, folder, filename):
	options = PDFExportOptions()
	options.FileName = filename
	#options.TargetUnit = ExportUnit.Meter
	views = List[ElementId]()
	views.Add(ElementId(id))
	result = doc.Export(folder, views, options)
	return result

full_path = None
if not do_create and txt_filepath:
	folderPath = '\\'.join(txt_filepath.split('\\')[:-1])
	filename = txt_filepath.split('\\')[-1].replace('.txt', '')
	#filename = folderPath.split('__')[-1].split('\\')[-1]
	#filename = txt_folderpath.replace('.txt', '')
	
	assert not os.path.isfile(txt_filepath.replace('.txt', '.pdf')), '.dxf already exists!'
	
	ExportPdf(viewId, folderPath, filename)
	full_path = txt_filepath.replace('.txt', '.pdf')

#Assign your output to the OUT variable
OUT = full_path
# ----------------------------------------
save_to_txt_py = Python(IN[0]=create_corridor_end2end_py, IN[1]=create_folder_py)  # IronPython2
# ---------- save_to_txt_py.python (29 lines) ----------
# Phython-Standard- und DesignScript-Bibliotheken laden
import sys
import os
import clr
clr.AddReference('ProtoGeometry')
from Autodesk.DesignScript.Geometry import *

# Die Eingaben für diesen Block werden in Form einer Liste in den IN-Variablen gespeichert.
dataEnteringNode = IN
room_dict = IN[0]
txt_filepath = IN[1][0]

# Code unterhalb dieser Linie platzieren
if bool(room_dict) and txt_filepath:
	stdout_original = sys.stdout
	stdout_file = open(txt_filepath, 'w')
	sys.stdout = stdout_file
	
	for key in room_dict:
	    print key
	    for coord in room_dict[key]:
	        print "COORD_"+str(coord[0])+","+str(coord[1])
	    print ""
	
	sys.stdout = stdout_original
	stdout_file.close()

# Weisen Sie Ihre Ausgabe der OUT-Variablen zu.
OUT = [room_dict, txt_filepath]
# ----------------------------------------

watch_2 = Watch(export2dxf_py)
watch_3 = Watch(export2pdf_py)
watch_4 = Watch(save_to_txt_py)
watch_5 = Watch(create_folder_py)
watch_6 = Watch(create_corridor_end2end_py)
python_script = Python(IN[0]=id)  # CPython3
# ---------- python_script.python (46 lines) ----------
import sys
import clr
import System
from System.IO import *
clr.AddReference('ProtoGeometry')
from Autodesk.DesignScript.Geometry import *

clr.AddReference("RevitServices")
import RevitServices
from RevitServices.Persistence import DocumentManager 

clr.AddReference("RevitAPI")
from Autodesk.Revit.DB import *

clr.AddReference('System.Drawing')
import System.Drawing
from System.Drawing import *
import os
import tempfile

doc = DocumentManager.Instance.CurrentDBDocument

# Get the current active view
view = doc.ActiveView

viewId = IN[0]
elementId = ElementId(viewId)
view = doc.GetElement(elementId)

# Get the view's crop box
cropBox = view.CropBox

# Get the bottom left and top right corner coordinates
bottomLeft = cropBox.Min
topRight = cropBox.Max

# Extract the x and y coordinates for bottom left corner
x_bottom_left = bottomLeft.X
y_bottom_left = bottomLeft.Y

# Extract the x and y coordinates for top right corner
x_top_right = topRight.X
y_top_right = topRight.Y

# Return the coordinates
OUT = (x_bottom_left, y_bottom_left), (x_top_right, y_top_right)
# ----------------------------------------
python_script_2 = Python()  # CPython3; unwired: IN[0]
# ---------- python_script_2.python (62 lines) ----------
import sys
import clr
import System
from System.IO import *
clr.AddReference('ProtoGeometry')
from Autodesk.DesignScript.Geometry import *

clr.AddReference("RevitServices")
import RevitServices
from RevitServices.Persistence import DocumentManager 

clr.AddReference("RevitAPI")
from Autodesk.Revit.DB import *

import clr
clr.AddReference("RevitAPI")
from Autodesk.Revit.DB import *
import clr
clr.AddReference("RevitAPI")
from Autodesk.Revit.DB import *
# Get the active view
doc = DocumentManager.Instance.CurrentDBDocument
view = doc.ActiveView

import clr
clr.AddReference("RevitAPI")
from Autodesk.Revit.DB import *
# Get the active document
# Get the active document
# Get the active document
doc = DocumentManager.Instance.CurrentDBDocument

# Retrieve the walls in the document
wall_collector = FilteredElementCollector(doc).OfClass(Wall)
walls = wall_collector.ToElements()

# Retrieve all the vertices from the walls
all_vertices = []
for wall in walls:
    wall_location = wall.Location
    if isinstance(wall_location, LocationCurve):
        curve = wall_location.Curve
        start_point = curve.GetEndPoint(0)
        end_point = curve.GetEndPoint(1)

        all_vertices.append(start_point)
        all_vertices.append(end_point)

# Create a unique list of vertices
unique_vertices = list(set(all_vertices))

# Find the minimum and maximum vertices from the unique list
if unique_vertices:
    min_vertex = min(unique_vertices, key=lambda vertex: (vertex.X, vertex.Y, vertex.Z))
    max_vertex = max(unique_vertices, key=lambda vertex: (vertex.X, vertex.Y, vertex.Z))
    
    x_min , y_min = min_vertex.X , min_vertex.Y
    x_max , y_max = max_vertex.X , max_vertex.Y
    
    OUT = [x_min , y_min , x_max , y_max]
else:
    OUT = None
# ----------------------------------------
python_script_3 = Python(IN[0]=create_corridor_end2end_py, IN[1]=python_script_2, IN[2]=parameter_processing_py)  # CPython3
# ---------- python_script_3.python (53 lines) ----------
import sys
import clr
import System
from System.IO import *
clr.AddReference('ProtoGeometry')
from Autodesk.DesignScript.Geometry import *

clr.AddReference("RevitServices")
import RevitServices
from RevitServices.Persistence import DocumentManager 

clr.AddReference("RevitAPI")
from Autodesk.Revit.DB import *

clr.AddReference('System.Drawing')
import System.Drawing
from System.Drawing import *
import os
import tempfile

def extract_lists_with_string(room_dict, type):
    extracted_lists = []
    for key in room_dict:
        if type in key:
            extracted_lists.append(room_dict[key])
    return extracted_lists
    
dict = IN[0]
cooridnates_in_view = IN[1]
width_in_dynamo = float(IN[2][1][0])
height_in_dynamo = float(IN[2][1][1])

scale_in_x = (cooridnates_in_view[2] - cooridnates_in_view[0]) / width_in_dynamo
scale_in_y = (cooridnates_in_view[3] - cooridnates_in_view[1]) / height_in_dynamo

origins = extract_lists_with_string(dict , "ORIGIN")
destinations = extract_lists_with_string(dict , "DESTINATION")

origins_in_view = []
for origin in origins : 
    origin_in_view =  [
        [origin[0][0] * scale_in_x , origin[0][1] * scale_in_y] , [origin[1][0] * scale_in_x , origin[1][1] * scale_in_y]
    ]
    origins_in_view.append(origin_in_view)

destinations_in_view = []
for destination in destinations : 
    destination_in_view =  [
        [destination[0][0] * scale_in_x , destination[0][1] * scale_in_y]  , [destination[1][0] * scale_in_x , destination[1][1] * scale_in_y]
    ]
    destinations_in_view.append(destination_in_view)

OUT = [origins_in_view[0]] , destinations_in_view
# ----------------------------------------
python_script_4 = Python(IN[0]=id, IN[1]=python_script, IN[2]=python_script_3, IN[3]=python_script_2)  # CPython3
# ---------- python_script_4.python (126 lines) ----------
import sys
import clr
import System
from System.IO import *
clr.AddReference('ProtoGeometry')
from Autodesk.DesignScript.Geometry import *

clr.AddReference("RevitServices")
import RevitServices
from RevitServices.Persistence import DocumentManager 

clr.AddReference("RevitAPI")
from Autodesk.Revit.DB import *

clr.AddReference('System.Drawing')
import System.Drawing
from System.Drawing import *
import os
import tempfile
sys.path.append(r'D:\Work\TUM_Research\HiWiPatrick\PedSimAutomation\DynamoDependencies\DynamoVEnv\lib\site-packages')
from PIL import Image as im

def convert_to_meter(internal_value):
	if isinstance(internal_value, list):
		return [UnitUtils.ConvertFromInternalUnits(value, UnitTypeId.Meters) for value in internal_value]
	return float(UnitUtils.ConvertFromInternalUnits(internal_value, UnitTypeId.Meters))


def transform_coordinates(image, x0, y0, x1, y1, xmin, ymin, xmax, ymax):
    # Get the width and height of the image
    width, height = image.size

    # Calculate the scaling factors
    scale_x = width / (x1 - x0)
    scale_y = height / (y1 - y0)

    # Transform the bounding box coordinates to pixel units
    pixel_xmin = int((xmin - x0) * scale_x)
    pixel_ymin = int(height - (ymax - y0) * scale_y)
    pixel_xmax = int((xmax - x0) * scale_x)
    pixel_ymax = int(height - (ymin - y0) * scale_y)

    return pixel_xmin, pixel_ymin, pixel_xmax, pixel_ymax

def change_bounding_box_color(image , pixels, xmin, ymin, xmax, ymax, color):
    # Load the image


    # Get the image dimensions
    width, height = image.size

    # Convert the RGB color to a tuple
    rgb_color = tuple(color)

    # Ensure the bounding box coordinates are within the image dimensions
    xmin = max(0, min(xmin, width - 1))
    ymin = max(0, min(ymin, height - 1))
    xmax = max(0, min(xmax, width - 1))
    ymax = max(0, min(ymax, height - 1))

    # Iterate over the bounding box region and change the color
    for x in range(xmin, xmax + 1):
        for y in range(ymin, ymax + 1):
            pixels[x, y] = rgb_color
            
    
    
    return image , pixels
    
def convert_to_view_geometry(bbox , x_min , y_min) : 
    reshaped_bbox = [*bbox[0] , *bbox[1]]
    return [
        dim + x_min if d % 2 == 0 else dim + y_min for d , dim in enumerate(reshaped_bbox)
    ]

doc = DocumentManager.Instance.CurrentDBDocument

viewId = IN[0]
elementId = ElementId(viewId)
view = doc.GetElement(elementId)
#view = doc.ActiveView
options = ImageExportOptions()
options.ExportRange = ExportRange.CurrentView
options.ViewName = view.Name

temp_file = tempfile.mktemp(suffix=".png")

options.FilePath = temp_file
options.ZoomType = ZoomFitType.Zoom
options.PixelSize = 1024

doc.ExportImage(options)



origins , destinations = IN[2]

image_path = f"{temp_file[:-3]}jpg"
x0, y0, x1, y1 = *IN[1][0] , *IN[1][1]
x_min , y_min , x_max , y_max = [i - j for i , j in zip(IN[3] , [x0 , y0 , x1 , y1])]


image = im.open(image_path)
pixels = image.load()

color = (255, 0, 0)
for origin in origins : 

    xmin , ymin , xmax , ymax = convert_to_view_geometry(origin , x_min , y_min)
    pixel_coordinates = transform_coordinates(image, x0, y0, x1, y1, xmin, ymin, xmax, ymax)
    image , pixels = change_bounding_box_color(image , pixels, *pixel_coordinates, color)
    
color = (0, 255, 0)
for destination in destinations : 

    xmin , ymin , xmax , ymax = convert_to_view_geometry(destination , x_min , y_min)
    pixel_coordinates = transform_coordinates(image, x0, y0, x1, y1, xmin, ymin, xmax, ymax)
    image , pixels = change_bounding_box_color(image , pixels, *pixel_coordinates, color)
    
colored_temp = tempfile.mktemp(suffix=".png")
image.save(colored_temp)


out_img = Image.FromFile(colored_temp)

OUT = x_min , y_min , x_max , y_max
# ----------------------------------------
watch_image = WatchImageCore(image=python_script_4)
exportViewAsTempPng = Python(IN[0]=id)  # CPython3
# ---------- exportViewAsTempPng.python (36 lines) ----------
# IN[0] Element id of view

import clr
import System
from System.IO import *
clr.AddReference('ProtoGeometry')
from Autodesk.DesignScript.Geometry import *

clr.AddReference("RevitServices")
import RevitServices
from RevitServices.Persistence import DocumentManager 

clr.AddReference("RevitAPI")
from Autodesk.Revit.DB import *
import tempfile

doc = DocumentManager.Instance.CurrentDBDocument

viewId = IN[0]
elementId = ElementId(viewId)
view = doc.GetElement(elementId)

screenshot_of_view_path = tempfile.mktemp(suffix=".png")

options = ImageExportOptions()
options.ExportRange = ExportRange.CurrentView
options.ViewName = view.Name
options.FilePath = screenshot_of_view_path
options.ZoomType = ZoomFitType.Zoom
options.PixelSize = 1024

doc.ExportImage(options)

saved_image_path = f"{screenshot_of_view_path[:-3]}jpg" # Saving as JPG format (unusual behavior)

OUT = saved_image_path
# ----------------------------------------
getViewDimensions = Python(IN[0]=id)  # CPython3
# ---------- getViewDimensions.python (31 lines) ----------
#IN[0]: view element id

import sys
import clr

clr.AddReference('ProtoGeometry')
from Autodesk.DesignScript.Geometry import *

clr.AddReference("RevitServices")
import RevitServices
from RevitServices.Persistence import DocumentManager

clr.AddReference("RevitAPI")
from Autodesk.Revit.DB import *

doc = DocumentManager.Instance.CurrentDBDocument

viewId = IN[0]
elementId = ElementId(viewId)
view = doc.GetElement(elementId)
cropBox = view.CropBox

minVertex = cropBox.Min
maxVertex = cropBox.Max

x_bottom_left = minVertex.X
y_bottom_left = minVertex.Y
x_top_right = maxVertex.X
y_top_right = maxVertex.Y

OUT = x_bottom_left, y_bottom_left, x_top_right, y_top_right, x_top_right - x_bottom_left, y_top_right - y_bottom_left
# ----------------------------------------
getTransformationFromDynamoToView = Python(IN[0]=id, IN[1]=parameter_processing_py)  # CPython3
# ---------- getTransformationFromDynamoToView.python (65 lines) ----------
#IN[0]: view element id
#IN[1]: Output of Input prep. script

import sys
import clr
clr.AddReference('ProtoGeometry')
from Autodesk.DesignScript.Geometry import *

clr.AddReference("RevitServices")
import RevitServices
from RevitServices.Persistence import DocumentManager

clr.AddReference("RevitAPI")
from Autodesk.Revit.DB import *

def convert_meter_to_unit(pre_value):
    tempo_list = []
    tempo_value = 0
    if isinstance(pre_value, list):
        len_list = len(pre_value)
        for ii in range(len_list):
            tempo_list.append (float(UnitUtils.ConvertToInternalUnits(pre_value[ii], UnitTypeId.Meters)))
        pre_value = tempo_list
    else:
        tempo_value = float(UnitUtils.ConvertToInternalUnits(pre_value, UnitTypeId.Meters))
        pre_value = tempo_value
    return pre_value

doc = DocumentManager.Instance.CurrentDBDocument

viewId = IN[0]
elementId = ElementId(viewId)
view = doc.GetElement(elementId)

walls = FilteredElementCollector(doc).OfClass(Wall).ToElements()

non_unique_vertices = []
for wall in walls:
    wall_location = wall.Location
    if isinstance(wall_location, LocationCurve):
        wall_location_curve = wall_location.Curve
        curve_start_point = wall_location_curve.GetEndPoint(0)
        curve_end_point = wall_location_curve.GetEndPoint(1)

        non_unique_vertices.append(curve_start_point)
        non_unique_vertices.append(curve_end_point)

geometry_vertices = list(set(non_unique_vertices))

total_x_in_dynamo = convert_meter_to_unit(IN[1][1][0])
total_y_in_dynamo = convert_meter_to_unit(IN[1][1][1])

if geometry_vertices:
    min_vertex = min(geometry_vertices, key=lambda vertex: (vertex.X, vertex.Y, vertex.Z)) #* bottom left of outer rectangle
    max_vertex = max(geometry_vertices, key=lambda vertex: (vertex.X, vertex.Y, vertex.Z)) #* top right of outer rectangle
    
    x_min , y_min = min_vertex.X , min_vertex.Y
    x_max , y_max = max_vertex.X , max_vertex.Y

    total_x_in_view = x_max - x_min
    total_y_in_view = y_max - y_min
    
    OUT = total_x_in_view / total_x_in_dynamo , total_y_in_view / total_y_in_dynamo
else : 
    OUT = None
# ----------------------------------------
getScaledOriginsAndDestinations = Python(IN[0]=create_corridor_end2end_py, IN[1]=getTransformationFromDynamoToView, IN[2]=getViewDimensions)  # CPython3
# ---------- getScaledOriginsAndDestinations.python (55 lines) ----------
#IN[0]: room dict.
#IN[1]: scales from transformation script
#IN[2]: view's bounding box and bounding box's width and height from getviewdimensions script

import clr
from System.Drawing import *
from Autodesk.DesignScript.Geometry import *
from RevitServices.Persistence import DocumentManager 
from Autodesk.Revit.DB import *

def extract_lists_with_string(room_dict, type):
    extracted_lists = []
    for key in room_dict:
        if type in key:
            extracted_lists.append(room_dict[key])
    return extracted_lists

def convert_meter_to_unit(pre_value):
    tempo_list = []
    tempo_value = 0
    if isinstance(pre_value, list):
        len_list = len(pre_value)
        for ii in range(len_list):
            tempo_list.append (float(UnitUtils.ConvertToInternalUnits(pre_value[ii], UnitTypeId.Meters)))
        pre_value = tempo_list
    else:
        tempo_value = float(UnitUtils.ConvertToInternalUnits(pre_value, UnitTypeId.Meters))
        pre_value = tempo_value
    return pre_value
    
dict = IN[0]
scale_in_x , scale_in_y = IN[1]
x_min_view , y_min_view = IN[2][:2]

origins = extract_lists_with_string(dict , "ORIGIN")
destinations = extract_lists_with_string(dict , "DESTINATION")

transform_in_x = lambda pre_transformation_value : convert_meter_to_unit(pre_transformation_value) * scale_in_x * 0.93 - x_min_view - 36.3
transform_in_y = lambda pre_transformation_value : convert_meter_to_unit(pre_transformation_value) * scale_in_y * 1.3 - y_min_view - 8.5

origins_in_view = []
for origin in origins : 
    origin_in_view =  [
        [transform_in_x(origin[0][0]) , transform_in_y(origin[0][1])] , [transform_in_x(origin[1][0]) , transform_in_y(origin[1][1])]
    ]
    origins_in_view.append(origin_in_view)

destinations_in_view = []
for destination in destinations : 
    destination_in_view =  [
        [transform_in_x(destination[0][0]) , transform_in_y(destination[0][1])] , [transform_in_x(destination[1][0]) , transform_in_y(destination[1][1])]
    ]
    destinations_in_view.append(destination_in_view)

OUT = origins_in_view , destinations_in_view
# ----------------------------------------
exportViewAsTempPng_2 = Python(IN[0]=exportViewAsTempPng, IN[1]=getViewDimensions, IN[2]=getScaledOriginsAndDestinations)  # CPython3
# ---------- exportViewAsTempPng_2.python (82 lines) ----------
# IN[0] : path of temp image created in script that runs before this one
# IN[1] : min and max in both x and y in view coordinate system in revit units
# IN[2] : origin and destination lists from origin and destination prepper script

import sys
sys.path.append(r'D:\Work\TUM_Research\HiWiPatrick\PedSimAutomation\DynamoDependencies\DynamoVEnv\lib\site-packages')

import clr
import System
from System.IO import *
clr.AddReference('ProtoGeometry')
from Autodesk.DesignScript.Geometry import *

clr.AddReference("RevitServices")
import RevitServices
from RevitServices.Persistence import DocumentManager 

clr.AddReference("RevitAPI")
from Autodesk.Revit.DB import *

clr.AddReference('System.Drawing')
import System.Drawing
from System.Drawing import *
import os
import tempfile
from PIL import Image as im

def transform_coordinates(image , x0_original, y0_original, x1_original, y1_original, x_min_new, y_min_new, x_max_new, y_max_new):
    width, height = image.size

    scale_x = width / (x1_original - x0_original)
    scale_y = height / (y1_original - y0_original)

    pixel_xmin = int((x_min_new) * scale_x)
    pixel_ymin = int(height - (y_max_new) * scale_y)
    pixel_xmax = int((x_max_new) * scale_x)
    pixel_ymax = int(height - (y_min_new) * scale_y)

    return pixel_xmin, pixel_ymin, pixel_xmax, pixel_ymax

def change_bounding_box_color(image, pixels, x_min, y_min, x_max, y_max, color):
    width, height = image.size

    rgb_color = tuple(color)

    x_min = max(0, min(x_min, width - 1))
    y_min = max(0, min(y_min, height - 1))
    x_max = max(0, min(x_max, width - 1))
    y_max = max(0, min(y_max, height - 1))

    for x in range(x_min, x_max + 1):
        for y in range(y_min, y_max + 1):
            pixels[x, y] = rgb_color

    return image, pixels

image_path = IN[0]
view_dims = IN[1][:4]
origins , destinations = IN[2]

image = im.open(image_path)
pixels = image.load()

origin_color = (255, 0, 0)
destination_color = (0, 255, 0)

for origin in origins : 
    reshaped_origin = [*origin[0] , *origin[1]]
    pixel_coordinates = transform_coordinates(image , *view_dims , *reshaped_origin)
    image , pixels = change_bounding_box_color(image , pixels , *pixel_coordinates , origin_color)

for destination in destinations : 
    reshaped_destination = [*destination[0] , *destination[1]]
    pixel_coordinates = transform_coordinates(image , *view_dims , *reshaped_destination)
    image , pixels = change_bounding_box_color(image , pixels , *pixel_coordinates , destination_color)

overlayed_image_path = tempfile.mktemp(suffix=".png")
image.save(overlayed_image_path)

result = Image.FromFile(overlayed_image_path)

OUT = result
# ----------------------------------------
floorPlanWithOriginAndDestinationMarkers = WatchImageCore(image=exportViewAsTempPng_2)
detectEdges = Python(IN[0]=exportViewAsTempPng)  # CPython3
# ---------- detectEdges.python (38 lines) ----------
# Load the Python Standard and DesignScript Libraries
import sys
sys.path.append(r'D:\Work\TUM_Research\HiWiPatrick\PedSimAutomation\DynamoDependencies\DynamoVEnv\lib\site-packages')
import clr
clr.AddReference('ProtoGeometry')
from Autodesk.DesignScript.Geometry import *
import numpy as np
from skimage import io, color, feature, filters
from skimage.transform import probabilistic_hough_line
from skimage.morphology import square

# Load the image
image = io.imread(IN[0])

# Convert the image to grayscale
gray_image = color.rgb2gray(image)

# Apply Gaussian blur
blurred_image = filters.gaussian(gray_image, sigma=1)

# Perform Canny edge detection
edges = feature.canny(blurred_image)

# Apply dilation to enhance the edges if needed
dilated_edges = filters.rank.maximum(edges, square(3))

# Use probabilistic Hough line transform to detect lines
lines = probabilistic_hough_line(dilated_edges, threshold=10, line_length=50, line_gap=10)

# Find intersections to locate corners
corners = []
for line1 in lines:
    for line2 in lines:
        intersection = line_intersection(line1, line2)
        if intersection is not None:
            corners.append(intersection)

OUT = corners
# ----------------------------------------
